# Grasshopper definition Digital Column 2.0.gh (Grasshopper 0.9.76)
# plug-ins: treesloth01, Anemone, Weaverbird, Mesh Pipe

xy = XYPlane(Origin=Point(0, 0, 0))
polygon = Polygon(Plane=xy, Radius=Slider(350, range=0..1000), Segments=Slider(3, range=3..8), FilletRadius=0)  # -> Polygon, Length
crv = Curve(<curve referenced from the Rhino model>)

# ---- group: branch sorting
crv_2 = Curve(crv)
pln = Plane(xy)
tstat = TreeStatistics(Tree=crv_2)  # -> Paths, Length, Count
item = ListItem(List=reverse(tstat.Paths), Index=0, Wrap=True)
dpath = DeconstructPath(Branch=item)
sort = SortList(Keys=dpath)  # -> reverse(Keys), ValuesA
item_2 = ListItem(List=sort.Keys, Index=0, Wrap=True)
path_mask = Panel("{*;x;*}")
to_replace = Panel("x")
int = Integer(item_2)
rep = ReplaceText(Text=path_mask, Find=to_replace, Replace=int, RecursiveReplace=False)
split = SplitTree(Data=crv_2, Masks=flatten(rep))  # -> Positive, Negative
split_2 = SplitTree(Data=pln, Masks=flatten(rep))  # -> Positive, Negative

# ---- group: ROTATION VALUES / levels
series = Series(Start="2", Step=1, Count=Slider(4, range=1..5))

# ---- group: ROTATION VALUES / circumference
pi = Pi(Factor=2)

# ---- group: ROTATION VALUES
profile_curve_sides = Panel("4")
expression = Expression(x=pi, y=profile_curve_sides, z=series, Expression="(x/y)/(2^z)")
panel = Panel(expression)
item_3 = ListItem(List=expression, Index=0, Wrap=True)  # -> Item, Item1, Item2, Item3

# ----
branch_rotation = Slider(0, range=0..2)
branch_count = Slider(1, range=1..6)
frame_count = Slider(20, range=5..20)
distance = Slider(2000, range=0..3000)
z_angle = Slider(0.5, range=0..0.5)
list = ValueList({"Perpendicular Frame": 0, "Horizontal Frame": 1}, selected="Perpendicular Frame")
list_2 = ValueList({"Line": 0, "Curve": 1}, selected="Line")

# ---- group: Branch Curves
num = Number(branch_rotation)
num_2 = Number(branch_count)
G = Gate(list_2)
pln_2 = Plane(split_2.Positive)
num_3 = Number(z_angle)
num_4 = Number(distance)
num_5 = Number(frame_count)
pi_2 = Pi(Factor="2")
range = Range(Domain=pi_2, Steps=num_2)
pi_3 = Pi(Factor=num)
item_4 = ListItem(List=pln_2, Index=0, Wrap=True)
shift = ShiftList(List=range, Shift="-1", Wrap=invert(True))
pi_4 = Pi(Factor=num_3)
prot = RotatePlane(Plane=item_4, Angle=pi_3)
pt = PointPolar(BasePlane=prot, XYAngle=shift, ZAngle=pi_4, Offset=num_4)
vec2pt = Vector2Pt(PointA=prot, PointB=pt, Unitize=False)  # -> Vector, Length
line = LineSDL(Start=prot, Direction=vec2pt.Vector, Length=vec2pt.Length)
end = EndPoints(Curve=line)  # -> Start, End
pln_3 = Plane(prot)
expression_2 = Expression(x=num_5, Expression="x-1")
arc = ArcSED(Start=end.Start, End=end.End, Direction=prot)  # -> Arc, Plane, Radius
project = Project(Geometry=vec2pt.Vector, Plane=pln_3)  # -> Geometry, Transform
filter = StreamFilter(Gate=G, Stream0=line, Stream1=arc.Arc)

# ---- group: Branch Frames
G_2 = Gate(list)
pln_4 = Plane(pln_3)
crv_3 = Curve(filter)
vec = Vector(project.Geometry)
num_6 = Number(expression_2)
num_7 = Number(Slider(0, range=0..1))
num_8 = Number(Slider(0, range=0..1))
pframes = PerpFrames(Curve=crv_3, Count=num_6, Align=True)  # -> simplify(Frames), Parameters
hframes = HorizontalFrames(Curve=crv_3, Count=num_6)  # -> Frames, Parameters
align = AlignPlane(Plane=pframes.Frames, Direction=graft(vec))  # -> simplify(Plane), Angle
align_2 = AlignPlane(Plane=hframes.Frames, Direction=graft(vec))  # -> simplify(Plane), Angle
dom = ConstructDomain(DomainStart=num_7, DomainEnd=num_8)
filter_2 = StreamFilter(Gate=list_2, Stream0=align.Plane, Stream1=pframes.Frames)
filter_3 = StreamFilter(Gate=list_2, Stream0=align_2.Plane, Stream1=hframes.Frames)
filter_4 = StreamFilter(Gate=G_2, Stream0=filter_2, Stream1=filter_3)
deplane = DeconstructPlane(Plane=filter_4)  # -> Origin, XAxis, YAxis, ZAxis
angle = Angle(VectorA=filter_4, VectorB=pln_4)  # -> Angle, Reflex
range_2 = Range(Domain=dom, Steps=num_6)
line_2 = LineSDL(Start=deplane.Origin, Direction=deplane.YAxis, Length=1)
multiplication = Multiplication(A=angle.Angle, B=range_2)
neg = Negative(Value=multiplication)
rotax = RotateAxis(Geometry=filter_4, Angle=neg, Axis=line_2)  # -> simplify(Geometry), Transform

# ---- group: Rotation Values DM
rotation_value = Number(item_3.Item)
frame_count_2 = Number(frame_count)
plane_to_match_with = Tree(rotax.Geometry)
profile_curves_to_match_with = Data(split.Positive)
expression_3 = Expression(x=frame_count_2, Expression="x-1")
range_3 = Range(Domain=rotation_value, Steps=expression_3)
tstat_2 = TreeStatistics(Tree=plane_to_match_with)  # -> Paths, Length, Count
graft = GraftTree(Tree=range_3, IncludeEmptyLists=True, IncludeNullItems=True)
tstat_3 = TreeStatistics(Tree=profile_curves_to_match_with)  # -> Paths, Length, Count
dup = DuplicateData(Data=graft, Number=tstat_2.Count, Order=True)
flip = FlipMatrix(Data=dup)  # -> simplify(Data)
item_5 = ListItem(List=tstat_3.Length, Index=0, Wrap=True)
graft_2 = GraftTree(Tree=flip, IncludeEmptyLists=True, IncludeNullItems=True)
dup_2 = DuplicateData(Data=graft_2, Number=item_5, Order=True)
neg_2 = Negative(Value=dup_2)
merge = Merge(Data1=dup_2, Data2=neg_2)  # -> simplify(Result)

# ---- group: Frames DM
data_to_match = Data(split_2.Positive)
branch_count_2 = Number(branch_count)
planes_to_match_with = Tree(rotax.Geometry)
group = Group(Objects=data_to_match)
dup_3 = DuplicateData(Data=simplify(group), Number=branch_count_2, Order=True)
tstat_4 = TreeStatistics(Tree=planes_to_match_with)  # -> Paths, Length, Count
graft_3 = GraftTree(Tree=dup_3, IncludeEmptyLists=True, IncludeNullItems=True)
graft_4 = GraftTree(Tree=tstat_4.Length, IncludeEmptyLists=True, IncludeNullItems=True)
dup_4 = DuplicateData(Data=graft_3, Number=graft_4, Order=True)
graft_5 = GraftTree(Tree=dup_4, IncludeEmptyLists=True, IncludeNullItems=True)
ungroup = Ungroup(Group=graft_5)  # -> simplify(Objects)

# ---- group: Curve Profile DM
data_to_match_2 = Data(split.Positive)
branch_count_3 = Number(branch_count)
planes_to_match_with_2 = Tree(rotax.Geometry)
group_2 = Group(Objects=data_to_match_2)
dup_5 = DuplicateData(Data=simplify(group_2), Number=branch_count_3, Order=True)
tstat_5 = TreeStatistics(Tree=planes_to_match_with_2)  # -> Paths, Length, Count
graft_6 = GraftTree(Tree=dup_5, IncludeEmptyLists=True, IncludeNullItems=True)
graft_7 = GraftTree(Tree=tstat_5.Length, IncludeEmptyLists=True, IncludeNullItems=True)
dup_6 = DuplicateData(Data=graft_6, Number=graft_7, Order=True)
graft_8 = GraftTree(Tree=dup_6, IncludeEmptyLists=True, IncludeNullItems=True)
ungroup_2 = Ungroup(Group=graft_8)  # -> simplify(Objects)

# ---- group: Profile Curve Placement
frames_from_profile_curves = Plane(ungroup)
profile_curves = Curve(ungroup_2)
rotation_values = Number(merge)
branch_frames = Plane(rotax.Geometry)
prot_2 = RotatePlane(Plane=frames_from_profile_curves, Angle=rotation_values)
graft_9 = GraftTree(Tree=branch_frames, IncludeEmptyLists=True, IncludeNullItems=True)
pl_origin = PlaneOrigin(Base=prot_2, Origin=graft_9)
padjust = AdjustPlane(Plane=pl_origin, Normal=graft_9)
orient = Orient(Geometry=profile_curves, Source=frames_from_profile_curves, Target=padjust)  # -> Geometry, Transform

# ---- group: Curve intersection recurtion
crv_4 = Curve(simplify(orient.Geometry))
fastloopstart = FastLoopStart(Iterations=Slider(0, range=0..3), Data=crv_4)  # -> port, Counter, Data
partition = PartitionList(List=fastloopstart.Data, Size="2")
item_6 = ListItem(List=partition, Index=0, Wrap=True)  # -> Item, Item1
rint = RegionIntersection(CurvesA=item_6.Item, CurvesB=item_6.Item1)  # -> simplify(Result)
shift_2 = ShiftPaths(Data=rint, Offset=-1)
fastloopend = FastLoopEnd(port=fastloopstart.port, Exit=False, Data=shift_2, RecordData=False, TimeOutVal=0)  # -> graft(Data)

# ---- group: branch sorting
crv_5 = Curve(orient.Geometry)
pln_5 = Plane(padjust)
tstat_6 = TreeStatistics(Tree=crv_5)  # -> Paths, Length, Count
item_7 = ListItem(List=reverse(tstat_6.Paths), Index=0, Wrap=True)
dpath_2 = DeconstructPath(Branch=item_7)
sort_2 = SortList(Keys=dpath_2)  # -> reverse(Keys), ValuesA
item_8 = ListItem(List=sort_2.Keys, Index=0, Wrap=True)
path_mask_2 = Panel("{*;x;*}")
to_replace_2 = Panel("x")
int_2 = Integer(item_8)
rep_2 = ReplaceText(Text=path_mask_2, Find=to_replace_2, Replace=int_2, RecursiveReplace=False)
split_3 = SplitTree(Data=crv_5, Masks=flatten(rep_2))  # -> Positive, Negative
split_4 = SplitTree(Data=pln_5, Masks=flatten(rep_2))  # -> Positive, Negative

# ----
branch_rotation_2 = Slider(0, range=0..2)
branch_count_4 = Slider(3, range=1..6)
frame_count_3 = Slider(20, range=5..20)
distance_2 = Slider(1482, range=0..3000)
z_angle_2 = Slider(0.337, range=0..0.5)
list_3 = ValueList({"Perpendicular Frame": 0, "Horizontal Frame": 1}, selected="Perpendicular Frame")
list_4 = ValueList({"Line": 0, "Curve": 1}, selected="Line")

# ---- group: Branch Curves
num_9 = Number(branch_rotation_2)
num_10 = Number(branch_count_4)
num_11 = Number(z_angle_2)
num_12 = Number(distance_2)
num_13 = Number(frame_count_3)
G_3 = Gate(list_4)
pln_6 = Plane(split_4.Positive)
pi_5 = Pi(Factor="2")
range_4 = Range(Domain=pi_5, Steps=num_10)
pi_6 = Pi(Factor=num_9)
item_9 = ListItem(List=pln_6, Index=0, Wrap=True)
shift_3 = ShiftList(List=range_4, Shift="-1", Wrap=invert(True))
pi_7 = Pi(Factor=num_11)
prot_3 = RotatePlane(Plane=item_9, Angle=pi_6)
pt_2 = PointPolar(BasePlane=prot_3, XYAngle=shift_3, ZAngle=pi_7, Offset=num_12)
vec2pt_2 = Vector2Pt(PointA=prot_3, PointB=pt_2, Unitize=False)  # -> Vector, Length
line_3 = LineSDL(Start=prot_3, Direction=vec2pt_2.Vector, Length=vec2pt_2.Length)
end_2 = EndPoints(Curve=line_3)  # -> Start, End
pln_7 = Plane(prot_3)
expression_4 = Expression(x=num_13, Expression="x-1")
arc_2 = ArcSED(Start=end_2.Start, End=end_2.End, Direction=prot_3)  # -> Arc, Plane, Radius
project_2 = Project(Geometry=vec2pt_2.Vector, Plane=pln_7)  # -> Geometry, Transform
filter_5 = StreamFilter(Gate=G_3, Stream0=line_3, Stream1=arc_2.Arc)

# ---- group: Sweep Column
branch_frames_2 = Plane(rotax.Geometry)
graft_10 = GraftTree(Tree=branch_frames_2, IncludeEmptyLists=True, IncludeNullItems=True)
crv_6 = Curve(fastloopend)
deplane_2 = DeconstructPlane(Plane=graft_10)  # -> Origin, XAxis, YAxis, ZAxis
line_4 = LineSDL(Start=deplane_2.Origin, Direction=deplane_2.XAxis, Length="1000")
ccx = CurveCurve(CurveA=crv_6, CurveB=line_4)  # -> Points, ParamsA, ParamsB
seam = Seam(Curve=crv_6, Seam=ccx.ParamsA)  # -> simplify(Curve)
shift_4 = ShiftPaths(Data=seam, Offset=-1)
relitem = RelativeItem(Tree=simplify(shift_4), Offset="{0}(+1)", WrapPaths=False, WrapItems=False)  # -> ItemA, ItemB
end_3 = EndPoints(Curve=relitem.ItemA)  # -> Start, End
end_4 = EndPoints(Curve=relitem.ItemB)  # -> Start, End
ln = Line(StartPoint=end_3.Start, EndPoint=end_4.Start)
swp2 = Sweep2(
    Rail1=reparameterize(graft(relitem.ItemA)),
    Rail2=reparameterize(graft(relitem.ItemB)),
    Sections=reparameterize(graft(ln)),
    SameHeight=False)

# ---- group: branch sorting
crv_7 = Curve(orient.Geometry)
pln_8 = Plane(padjust)
tstat_7 = TreeStatistics(Tree=crv_7)  # -> Paths, Length, Count
item_10 = ListItem(List=reverse(tstat_7.Paths), Index=0, Wrap=True)
dpath_3 = DeconstructPath(Branch=item_10)
sort_3 = SortList(Keys=dpath_3)  # -> reverse(Keys), ValuesA
item_11 = ListItem(List=sort_3.Keys, Index=0, Wrap=True)
path_mask_3 = Panel("{*;x;*}")
to_replace_3 = Panel("x")
int_3 = Integer(Slider(10, range=0..10))
rep_3 = ReplaceText(Text=path_mask_3, Find=to_replace_3, Replace=int_3, RecursiveReplace=False)
split_5 = SplitTree(Data=crv_7, Masks=flatten(rep_3))  # -> Positive, Negative
split_6 = SplitTree(Data=pln_8, Masks=flatten(rep_3))  # -> Positive, Negative

# ----
branch_rotation_3 = Slider(0.46, range=0..2)
branch_count_5 = Slider(1, range=1..6)
frame_count_4 = Slider(20, range=5..20)
distance_3 = Slider(1800, range=0..3000)
z_angle_3 = Slider(0.35, range=0..0.5)
list_5 = ValueList({"Perpendicular Frame": 0, "Horizontal Frame": 1}, selected="Perpendicular Frame")
list_6 = ValueList({"Line": 0, "Curve": 1}, selected="Curve")

# ---- group: Branch Curves
num_14 = Number(branch_rotation_3)
num_15 = Number(branch_count_5)
num_16 = Number(z_angle_3)
G_4 = Gate(list_6)
pln_9 = Plane(split_6.Positive)
num_17 = Number(distance_3)
num_18 = Number(frame_count_4)
pi_8 = Pi(Factor="2")
range_5 = Range(Domain=pi_8, Steps=num_15)
pi_9 = Pi(Factor=num_14)
item_12 = ListItem(List=pln_9, Index=0, Wrap=True)
shift_5 = ShiftList(List=range_5, Shift="-1", Wrap=invert(True))
pi_10 = Pi(Factor=num_16)
prot_4 = RotatePlane(Plane=item_12, Angle=pi_9)
pt_3 = PointPolar(BasePlane=prot_4, XYAngle=shift_5, ZAngle=pi_10, Offset=num_17)
vec2pt_3 = Vector2Pt(PointA=prot_4, PointB=pt_3, Unitize=False)  # -> Vector, Length
line_5 = LineSDL(Start=prot_4, Direction=vec2pt_3.Vector, Length=vec2pt_3.Length)
end_5 = EndPoints(Curve=line_5)  # -> Start, End
pln_10 = Plane(prot_4)
expression_5 = Expression(x=num_18, Expression="x-1")
arc_3 = ArcSED(Start=end_5.Start, End=end_5.End, Direction=prot_4)  # -> Arc, Plane, Radius
project_3 = Project(Geometry=vec2pt_3.Vector, Plane=pln_10)  # -> Geometry, Transform
filter_6 = StreamFilter(Gate=G_4, Stream0=line_5, Stream1=arc_3.Arc)

# ---- group: column visualization
brep = Brep(swp2)
mesh = MeshBrep(
    Brep=brep,
    Settings={GridMaxCount=0, GridMinCount=16, JaggedSeams=False, MaxEdgeLength=0, MinEdgeLength=0.0001, MinTolerance=0, Refine=True, RefineAngle=0, RelativeTolerance=0.65, SimplePlanes=True, Tolerance=0})
mjoin = MeshJoin(Meshes=flatten(mesh))
material = CreateMaterial(
    Diffuse=ColourSwatch(SwatchColor=RGB(255, 255, 255)),
    Specular=RGB(255, 255, 255),
    Emission=RGB(0, 0, 0),
    Transparency=0,
    Shine=Slider(24, range=0..100))
preview = CustomPreview(Geometry=mjoin, Shader=material)

# ---- group: Mesh loft visualization
crv_8 = Curve(shift_4)
mloft = MeshLoft(Curves=crv_8, Segments=300)
wbjoin = WeaverbirdsJoinMeshesAndWeld(Mesh=mloft, Weld=invert(False))
preview_2 = CustomPreview(Geometry=wbjoin, Shader=material)

# ---- group: Branch Frames
G_5 = Gate(list_3)
pln_11 = Plane(pln_7)
crv_9 = Curve(filter_5)
vec_2 = Vector(project_2.Geometry)
num_19 = Number(expression_4)
num_20 = Number(Slider(0, range=0..1))
num_21 = Number(Slider(0, range=0..1))
pframes_2 = PerpFrames(Curve=crv_9, Count=num_19, Align=True)  # -> simplify(Frames), Parameters
hframes_2 = HorizontalFrames(Curve=crv_9, Count=num_19)  # -> Frames, Parameters
align_3 = AlignPlane(Plane=pframes_2.Frames, Direction=graft(vec_2))  # -> simplify(Plane), Angle
align_4 = AlignPlane(Plane=hframes_2.Frames, Direction=graft(vec_2))  # -> simplify(Plane), Angle
dom_2 = ConstructDomain(DomainStart=num_20, DomainEnd=num_21)
filter_7 = StreamFilter(Gate=list_4, Stream0=align_3.Plane, Stream1=pframes_2.Frames)
filter_8 = StreamFilter(Gate=list_4, Stream0=align_4.Plane, Stream1=hframes_2.Frames)
filter_9 = StreamFilter(Gate=G_5, Stream0=filter_7, Stream1=filter_8)
deplane_3 = DeconstructPlane(Plane=filter_9)  # -> Origin, XAxis, YAxis, ZAxis
angle_2 = Angle(VectorA=filter_9, VectorB=pln_11)  # -> Angle, Reflex
range_6 = Range(Domain=dom_2, Steps=num_19)
line_6 = LineSDL(Start=deplane_3.Origin, Direction=deplane_3.YAxis, Length=1)
multiplication_2 = Multiplication(A=angle_2.Angle, B=range_6)
neg_3 = Negative(Value=multiplication_2)
rotax_2 = RotateAxis(Geometry=filter_9, Angle=neg_3, Axis=line_6)  # -> simplify(Geometry), Transform

G_6 = Gate(list_5)
pln_12 = Plane(pln_10)
crv_10 = Curve(filter_6)
vec_3 = Vector(project_3.Geometry)
num_22 = Number(expression_5)
num_23 = Number(Slider(1, range=0..1))
num_24 = Number(Slider(0, range=0..1))
pframes_3 = PerpFrames(Curve=crv_10, Count=num_22, Align=True)  # -> simplify(Frames), Parameters
hframes_3 = HorizontalFrames(Curve=crv_10, Count=num_22)  # -> Frames, Parameters
align_5 = AlignPlane(Plane=pframes_3.Frames, Direction=graft(vec_3))  # -> simplify(Plane), Angle
align_6 = AlignPlane(Plane=hframes_3.Frames, Direction=graft(vec_3))  # -> simplify(Plane), Angle
dom_3 = ConstructDomain(DomainStart=num_23, DomainEnd=num_24)
filter_10 = StreamFilter(Gate=list_6, Stream0=align_5.Plane, Stream1=pframes_3.Frames)
filter_11 = StreamFilter(Gate=list_6, Stream0=align_6.Plane, Stream1=hframes_3.Frames)
filter_12 = StreamFilter(Gate=G_6, Stream0=filter_10, Stream1=filter_11)
deplane_4 = DeconstructPlane(Plane=filter_12)  # -> Origin, XAxis, YAxis, ZAxis
angle_3 = Angle(VectorA=filter_12, VectorB=pln_12)  # -> Angle, Reflex
range_7 = Range(Domain=dom_3, Steps=num_22)
line_7 = LineSDL(Start=deplane_4.Origin, Direction=deplane_4.YAxis, Length=1)
multiplication_3 = Multiplication(A=angle_3.Angle, B=range_7)
neg_4 = Negative(Value=multiplication_3)
rotax_3 = RotateAxis(Geometry=filter_12, Angle=neg_4, Axis=line_7)  # -> simplify(Geometry), Transform

# ---- group: Rotation Values DM
rotation_value_2 = Number(item_3.Item1)
frame_count_5 = Number(frame_count_3)
plane_to_match_with_2 = Tree(rotax_2.Geometry)
profile_curves_to_match_with_2 = Data(split_3.Positive)
expression_6 = Expression(x=frame_count_5, Expression="x-1")
range_8 = Range(Domain=rotation_value_2, Steps=expression_6)
tstat_8 = TreeStatistics(Tree=plane_to_match_with_2)  # -> Paths, Length, Count
graft_11 = GraftTree(Tree=range_8, IncludeEmptyLists=True, IncludeNullItems=True)
tstat_9 = TreeStatistics(Tree=profile_curves_to_match_with_2)  # -> Paths, Length, Count
dup_7 = DuplicateData(Data=graft_11, Number=tstat_8.Count, Order=True)
flip_2 = FlipMatrix(Data=dup_7)  # -> simplify(Data)
item_13 = ListItem(List=tstat_9.Length, Index=0, Wrap=True)
graft_12 = GraftTree(Tree=flip_2, IncludeEmptyLists=True, IncludeNullItems=True)
dup_8 = DuplicateData(Data=graft_12, Number=item_13, Order=True)
neg_5 = Negative(Value=dup_8)
merge_2 = Merge(Data1=dup_8, Data2=neg_5)  # -> simplify(Result)

# ---- group: Frames DM
data_to_match_3 = Data(split_4.Positive)
branch_count_6 = Number(branch_count_4)
planes_to_match_with_3 = Tree(rotax_2.Geometry)
group_3 = Group(Objects=data_to_match_3)
dup_9 = DuplicateData(Data=simplify(group_3), Number=branch_count_6, Order=True)
tstat_10 = TreeStatistics(Tree=planes_to_match_with_3)  # -> Paths, Length, Count
graft_13 = GraftTree(Tree=dup_9, IncludeEmptyLists=True, IncludeNullItems=True)
graft_14 = GraftTree(Tree=tstat_10.Length, IncludeEmptyLists=True, IncludeNullItems=True)
dup_10 = DuplicateData(Data=graft_13, Number=graft_14, Order=True)
graft_15 = GraftTree(Tree=dup_10, IncludeEmptyLists=True, IncludeNullItems=True)
ungroup_3 = Ungroup(Group=graft_15)  # -> simplify(Objects)

# ---- group: Curve Profile DM
data_to_match_4 = Data(split_3.Positive)
planes_to_match_with_4 = Tree(rotax_2.Geometry)
branch_count_7 = Number(branch_count_4)
group_4 = Group(Objects=data_to_match_4)
dup_11 = DuplicateData(Data=simplify(group_4), Number=branch_count_7, Order=True)
tstat_11 = TreeStatistics(Tree=planes_to_match_with_4)  # -> Paths, Length, Count
graft_16 = GraftTree(Tree=dup_11, IncludeEmptyLists=True, IncludeNullItems=True)
graft_17 = GraftTree(Tree=tstat_11.Length, IncludeEmptyLists=True, IncludeNullItems=True)
dup_12 = DuplicateData(Data=graft_16, Number=graft_17, Order=True)
graft_18 = GraftTree(Tree=dup_12, IncludeEmptyLists=True, IncludeNullItems=True)
ungroup_4 = Ungroup(Group=graft_18)  # -> simplify(Objects)

# ---- group: Rotation Values DM
frame_count_6 = Number(frame_count_4)
rotation_value_3 = Number(item_3.Item)
plane_to_match_with_3 = Tree(rotax_3.Geometry)
profile_curves_to_match_with_3 = Data(split_5.Positive)
expression_7 = Expression(x=frame_count_6, Expression="x-1")
range_9 = Range(Domain=rotation_value_3, Steps=expression_7)
tstat_12 = TreeStatistics(Tree=plane_to_match_with_3)  # -> Paths, Length, Count
graft_19 = GraftTree(Tree=range_9, IncludeEmptyLists=True, IncludeNullItems=True)
tstat_13 = TreeStatistics(Tree=profile_curves_to_match_with_3)  # -> Paths, Length, Count
dup_13 = DuplicateData(Data=graft_19, Number=tstat_12.Count, Order=True)
flip_3 = FlipMatrix(Data=dup_13)  # -> simplify(Data)
item_14 = ListItem(List=tstat_13.Length, Index=0, Wrap=True)
graft_20 = GraftTree(Tree=flip_3, IncludeEmptyLists=True, IncludeNullItems=True)
dup_14 = DuplicateData(Data=graft_20, Number=item_14, Order=True)
neg_6 = Negative(Value=dup_14)
merge_3 = Merge(Data1=dup_14, Data2=neg_6)  # -> simplify(Result)

# ---- group: Frames DM
data_to_match_5 = Data(split_6.Positive)
planes_to_match_with_5 = Tree(rotax_3.Geometry)
branch_count_8 = Number(branch_count_5)
group_5 = Group(Objects=data_to_match_5)
dup_15 = DuplicateData(Data=simplify(group_5), Number=branch_count_8, Order=True)
tstat_14 = TreeStatistics(Tree=planes_to_match_with_5)  # -> Paths, Length, Count
graft_21 = GraftTree(Tree=dup_15, IncludeEmptyLists=True, IncludeNullItems=True)
graft_22 = GraftTree(Tree=tstat_14.Length, IncludeEmptyLists=True, IncludeNullItems=True)
dup_16 = DuplicateData(Data=graft_21, Number=graft_22, Order=True)
graft_23 = GraftTree(Tree=dup_16, IncludeEmptyLists=True, IncludeNullItems=True)
ungroup_5 = Ungroup(Group=graft_23)  # -> simplify(Objects)

# ---- group: Curve Profile DM
data_to_match_6 = Data(split_5.Positive)
branch_count_9 = Number(branch_count_5)
planes_to_match_with_6 = Tree(rotax_3.Geometry)
group_6 = Group(Objects=data_to_match_6)
dup_17 = DuplicateData(Data=simplify(group_6), Number=branch_count_9, Order=True)
tstat_15 = TreeStatistics(Tree=planes_to_match_with_6)  # -> Paths, Length, Count
graft_24 = GraftTree(Tree=dup_17, IncludeEmptyLists=True, IncludeNullItems=True)
graft_25 = GraftTree(Tree=tstat_15.Length, IncludeEmptyLists=True, IncludeNullItems=True)
dup_18 = DuplicateData(Data=graft_24, Number=graft_25, Order=True)
graft_26 = GraftTree(Tree=dup_18, IncludeEmptyLists=True, IncludeNullItems=True)
ungroup_6 = Ungroup(Group=graft_26)  # -> simplify(Objects)

# ---- group: Profile Curve Placement
frames_from_profile_curves_2 = Plane(ungroup_3)
profile_curves_2 = Curve(ungroup_4)
rotation_values_2 = Number(merge_2)
branch_frames_3 = Plane(rotax_2.Geometry)
prot_5 = RotatePlane(Plane=frames_from_profile_curves_2, Angle=rotation_values_2)
graft_27 = GraftTree(Tree=branch_frames_3, IncludeEmptyLists=True, IncludeNullItems=True)
pl_origin_2 = PlaneOrigin(Base=prot_5, Origin=graft_27)
padjust_2 = AdjustPlane(Plane=pl_origin_2, Normal=graft_27)
orient_2 = Orient(Geometry=profile_curves_2, Source=frames_from_profile_curves_2, Target=padjust_2)  # -> Geometry, Transform

# ----
list_7 = ValueList({"From Last Branch Item": 0, "Select Branch Item": 1}, selected="From Last Branch Item")

# ---- group: Profile Curve Placement
frames_from_profile_curves_3 = Plane(ungroup_5)
rotation_values_3 = Number(merge_3)
profile_curves_3 = Curve(ungroup_6)
branch_frames_4 = Plane(rotax_3.Geometry)
prot_6 = RotatePlane(Plane=frames_from_profile_curves_3, Angle=rotation_values_3)
graft_28 = GraftTree(Tree=branch_frames_4, IncludeEmptyLists=True, IncludeNullItems=True)
pl_origin_3 = PlaneOrigin(Base=prot_6, Origin=graft_28)
padjust_3 = AdjustPlane(Plane=pl_origin_3, Normal=graft_28)
orient_3 = Orient(Geometry=profile_curves_3, Source=frames_from_profile_curves_3, Target=padjust_3)  # -> Geometry, Transform

# ---- group: Curve intersection recurtion
crv_11 = Curve(orient_2.Geometry)
fastloopstart_2 = FastLoopStart(Iterations=Slider(1, range=0..3), Data=crv_11)  # -> port, Counter, Data
partition_2 = PartitionList(List=fastloopstart_2.Data, Size="2")
item_15 = ListItem(List=partition_2, Index=0, Wrap=True)  # -> Item, Item1
rint_2 = RegionIntersection(CurvesA=item_15.Item, CurvesB=item_15.Item1)  # -> simplify(Result)
shift_6 = ShiftPaths(Data=rint_2, Offset=-1)
fastloopend_2 = FastLoopEnd(port=fastloopstart_2.port, Exit=False, Data=shift_6, RecordData=False, TimeOutVal=0)  # -> graft(Data)

# ----
branch_rotation_4 = Slider(0, range=0..2)
branch_count_10 = Slider(4, range=1..6)
distance_4 = Slider(1414, range=0..3000)
z_angle_4 = Slider(0.35, range=0..0.5)
frame_count_7 = Slider(20, range=5..20)

# ---- group: Curve intersection recurtion
crv_12 = Curve(orient_3.Geometry)
fastloopstart_3 = FastLoopStart(Iterations=Slider(1, range=0..3), Data=crv_12)  # -> port, Counter, Data
partition_3 = PartitionList(List=fastloopstart_3.Data, Size="2")
item_16 = ListItem(List=partition_3, Index=0, Wrap=True)  # -> Item, Item1
rint_3 = RegionIntersection(CurvesA=item_16.Item, CurvesB=item_16.Item1)  # -> simplify(Result)
shift_7 = ShiftPaths(Data=rint_3, Offset=-1)
fastloopend_3 = FastLoopEnd(port=fastloopstart_3.port, Exit=False, Data=shift_7, RecordData=False, TimeOutVal=0)  # -> graft(Data)

# ----
list_8 = ValueList({"Perpendicular Frame": 0, "Horizontal Frame": 1}, selected="Perpendicular Frame")
list_9 = ValueList({"Line": 0, "Curve": 1}, selected="Line")

# ---- group: Sweep Column
branch_frames_5 = Plane(rotax_2.Geometry)
graft_29 = GraftTree(Tree=branch_frames_5, IncludeEmptyLists=True, IncludeNullItems=True)
crv_13 = Curve(fastloopend_2)
deplane_5 = DeconstructPlane(Plane=graft_29)  # -> Origin, XAxis, YAxis, ZAxis
line_8 = LineSDL(Start=deplane_5.Origin, Direction=deplane_5.XAxis, Length="1000")
ccx_2 = CurveCurve(CurveA=crv_13, CurveB=line_8)  # -> Points, ParamsA, ParamsB
seam_2 = Seam(Curve=crv_13, Seam=ccx_2.ParamsA)  # -> simplify(Curve)
shift_8 = ShiftPaths(Data=seam_2, Offset=-1)
relitem_2 = RelativeItem(Tree=simplify(shift_8), Offset="{0}(+1)", WrapPaths=False, WrapItems=False)  # -> ItemA, ItemB
end_6 = EndPoints(Curve=relitem_2.ItemA)  # -> Start, End
end_7 = EndPoints(Curve=relitem_2.ItemB)  # -> Start, End
ln_2 = Line(StartPoint=end_6.Start, EndPoint=end_7.Start)
swp2_2 = Sweep2(
    Rail1=reparameterize(graft(relitem_2.ItemA)),
    Rail2=reparameterize(graft(relitem_2.ItemB)),
    Sections=reparameterize(graft(ln_2)),
    SameHeight=False)

# ----
cluster = Cluster_5(branch_item_selection_0_1=0)  # -> selected_profile_curves, selected_profile_curve_frames, selected_path_tree_index
cluster_2 = Cluster(type_of_curve=0)  # -> branch_curves_crv, guide_vectors, base_plane_2

# ---- group: Sweep Column
branch_frames_6 = Plane(rotax_3.Geometry)
graft_30 = GraftTree(Tree=branch_frames_6, IncludeEmptyLists=True, IncludeNullItems=True)
crv_14 = Curve(fastloopend_3)
deplane_6 = DeconstructPlane(Plane=graft_30)  # -> Origin, XAxis, YAxis, ZAxis
line_9 = LineSDL(Start=deplane_6.Origin, Direction=deplane_6.XAxis, Length="1000")
ccx_3 = CurveCurve(CurveA=crv_14, CurveB=line_9)  # -> Points, ParamsA, ParamsB
seam_3 = Seam(Curve=crv_14, Seam=ccx_3.ParamsA)  # -> simplify(Curve)
shift_9 = ShiftPaths(Data=seam_3, Offset=-1)
relitem_3 = RelativeItem(Tree=simplify(shift_9), Offset="{0}(+1)", WrapPaths=False, WrapItems=False)  # -> ItemA, ItemB
end_8 = EndPoints(Curve=relitem_3.ItemA)  # -> Start, End
end_9 = EndPoints(Curve=relitem_3.ItemB)  # -> Start, End
ln_3 = Line(StartPoint=end_8.Start, EndPoint=end_9.Start)
swp2_3 = Sweep2(
    Rail1=reparameterize(graft(relitem_3.ItemA)),
    Rail2=reparameterize(graft(relitem_3.ItemB)),
    Sections=reparameterize(graft(ln_3)),
    SameHeight=False)

# ----
cluster_3 = Cluster_2(type_of_plane=0)
cluster_4 = Cluster_3()  # -> intersected_curves_crv, profile_curves_crv, frames_from_profile_curves_pl
cluster_5 = Cluster_4(
    mesh_visualization=0,
    S={ambient=RGB(0, 0, 0), diffuse=RGB(255, 105, 180), emission=RGB(76, 32, 54), shine=0.5, specular=RGB(255, 255, 255), transparency=0})  # -> sweep_surface, mesh_from_intersected_curves_m

# ---- group: column visualization
brep_2 = Brep(swp2_2)
mesh_2 = MeshBrep(
    Brep=brep_2,
    Settings={GridMaxCount=0, GridMinCount=16, JaggedSeams=False, MaxEdgeLength=0, MinEdgeLength=0.0001, MinTolerance=0, Refine=True, RefineAngle=0, RelativeTolerance=0.65, SimplePlanes=True, Tolerance=0})
mjoin_2 = MeshJoin(Meshes=flatten(mesh_2))
material_2 = CreateMaterial(
    Diffuse=ColourSwatch(SwatchColor=RGB(255, 255, 255)),
    Specular=RGB(255, 255, 255),
    Emission=RGB(0, 0, 0),
    Transparency=0,
    Shine=Slider(24, range=0..100))
preview_3 = CustomPreview(Geometry=mjoin_2, Shader=material_2)

# ---- group: Mesh loft visualization
crv_15 = Curve(shift_8)
mloft_2 = MeshLoft(Curves=crv_15, Segments=300)
wbjoin_2 = WeaverbirdsJoinMeshesAndWeld(Mesh=mloft_2, Weld=invert(False))
preview_4 = CustomPreview(Geometry=wbjoin_2, Shader=material_2)

# ---- group: column visualization
brep_3 = Brep(swp2_3)
mesh_3 = MeshBrep(
    Brep=brep_3,
    Settings={GridMaxCount=0, GridMinCount=16, JaggedSeams=False, MaxEdgeLength=0, MinEdgeLength=0.0001, MinTolerance=0, Refine=True, RefineAngle=0, RelativeTolerance=0.65, SimplePlanes=True, Tolerance=0})
mjoin_3 = MeshJoin(Meshes=flatten(mesh_3))
material_3 = CreateMaterial(
    Diffuse=ColourSwatch(SwatchColor=RGB(255, 255, 255)),
    Specular=RGB(255, 255, 255),
    Emission=RGB(0, 0, 0),
    Transparency=0,
    Shine=Slider(24, range=0..100))
preview_5 = CustomPreview(Geometry=mjoin_3, Shader=material_3)

# ---- group: Mesh loft visualization
crv_16 = Curve(shift_9)
mloft_3 = MeshLoft(Curves=crv_16, Segments=300)
wbjoin_3 = WeaverbirdsJoinMeshesAndWeld(Mesh=mloft_3, Weld=invert(False))
preview_6 = CustomPreview(Geometry=wbjoin_3, Shader=material_3)

# ----
branch_count_11 = Number(branch_count_10)
list_10 = ValueList({"Mesh from Sweep": 0, "Mesh Loft": 1}, selected="Mesh from Sweep")
material_4 = CreateMaterial(
    Diffuse=ColourSwatch(SwatchColor=RGB(255, 255, 255)),
    Specular=RGB(255, 255, 255),
    Emission=RGB(0, 0, 0),
    Transparency=0,
    Shine=Slider(24, range=0..100))

# ---- group: branch sorting
crv_17 = Curve(simplify(orient_2.Geometry))
pln_13 = Plane(simplify(padjust_2))
int_4 = Integer()
int_5 = Integer(list_7)
tstat_16 = TreeStatistics(Tree=crv_17)  # -> Paths, Length, Count
item_17 = ListItem(List=reverse(tstat_16.Paths), Index=0, Wrap=True)
dpath_4 = DeconstructPath(Branch=item_17)
sort_4 = SortList(Keys=dpath_4)  # -> reverse(Keys), ValuesA
item_18 = ListItem(List=sort_4.Keys, Index=0, Wrap=True)
path_mask_4 = Panel("{*;x;*}")
to_replace_4 = Panel("x")
int_6 = Integer(item_18)
rep_4 = ReplaceText(Text=path_mask_4, Find=to_replace_4, Replace=int_6, RecursiveReplace=False)
path = ConstructPath(Indices=int_4)

# ----
filter_13 = StreamFilter(Gate=int_5, Stream0=rep_4, Stream1=path)

# ---- group: branch sorting (continued)
split_7 = SplitTree(Data=crv_17, Masks=flatten(filter_13))  # -> Positive, Negative
split_8 = SplitTree(Data=pln_13, Masks=flatten(filter_13))  # -> Positive, Negative

# ---- group: Branch Curves
G_7 = Gate(list_9)
num_25 = Number(branch_rotation_4)
num_26 = Number(branch_count_10)
num_27 = Number(z_angle_4)
num_28 = Number(distance_4)
pln_14 = Plane(split_8.Positive)
pi_11 = Pi(Factor="2")
range_10 = Range(Domain=pi_11, Steps=num_26)
pi_12 = Pi(Factor=num_25)
item_19 = ListItem(List=pln_14, Index=0, Wrap=True)
shift_10 = ShiftList(List=range_10, Shift="-1", Wrap=invert(True))
pi_13 = Pi(Factor=num_27)
prot_7 = RotatePlane(Plane=item_19, Angle=pi_12)
pt_4 = PointPolar(BasePlane=prot_7, XYAngle=shift_10, ZAngle=pi_13, Offset=num_28)
vec2pt_4 = Vector2Pt(PointA=prot_7, PointB=pt_4, Unitize=False)  # -> Vector, Length
line_10 = LineSDL(Start=prot_7, Direction=vec2pt_4.Vector, Length=vec2pt_4.Length)
end_10 = EndPoints(Curve=line_10)  # -> Start, End
arc_4 = ArcSED(Start=end_10.Start, End=end_10.End, Direction=prot_7)  # -> Arc, Plane, Radius
filter_14 = StreamFilter(Gate=G_7, Stream0=line_10, Stream1=arc_4.Arc)
pln_15 = Plane(prot_7)

# ----
vec_4 = Vector(vec2pt_4.Vector)

# ---- group: Branch Frames
G_8 = Gate(list_8)
crv_18 = Curve(filter_14)
num_29 = Number(frame_count_7)
pln_16 = Plane(pln_15)
num_30 = Number(Slider(1, range=0..1))
num_31 = Number(Slider(0, range=0..1))
vec_5 = Vector(vec_4)
expression_8 = Expression(x=num_29, Expression="x-1")
project_4 = Project(Geometry=vec_5, Plane=pln_16)  # -> Geometry, Transform
cp = ControlPoints(Curve=crv_18)  # -> Points, Weights, Knots
pframes_4 = PerpFrames(Curve=crv_18, Count=expression_8, Align=True)  # -> simplify(Frames), Parameters
lng = ListLength(List=cp.Points)
hframes_4 = HorizontalFrames(Curve=crv_18, Count=expression_8)  # -> Frames, Parameters
lng_2 = ListLength(List=crv_18)
expression_9 = Expression(x=lng, Expression="if(x=2,0,1)")
dup_19 = DuplicateData(Data=pln_16, Number=lng_2, Order=True)
align_7 = AlignPlane(Plane=pframes_4.Frames, Direction=graft(project_4.Geometry))  # -> simplify(Plane), Angle
align_8 = AlignPlane(Plane=hframes_4.Frames, Direction=vec_5)  # -> simplify(Plane), Angle
graft_31 = GraftTree(Tree=dup_19, IncludeEmptyLists=True, IncludeNullItems=True)
lng_3 = ListLength(List=align_7.Plane)
dup_20 = DuplicateData(Data=expression_9, Number=lng_3, Order=True)
p_n_c = PickNChoose(Pattern=dup_20, Stream0=align_8.Plane, Stream1=hframes_4.Frames)
p_n_c_2 = PickNChoose(Pattern=dup_20, Stream0=align_7.Plane, Stream1=pframes_4.Frames)
filter_15 = StreamFilter(Gate=G_8, Stream0=p_n_c_2, Stream1=p_n_c)
dom_4 = ConstructDomain(DomainStart=num_30, DomainEnd=num_31)
range_11 = Range(Domain=dom_4, Steps=expression_8)
deplane_7 = DeconstructPlane(Plane=filter_15)  # -> Origin, XAxis, YAxis, ZAxis
angle_4 = Angle(VectorA=filter_15, VectorB=graft_31)  # -> Angle, Reflex
line_11 = LineSDL(Start=deplane_7.Origin, Direction=deplane_7.YAxis, Length=1000)
multiplication_4 = Multiplication(A=angle_4.Angle, B=range_11)
neg_7 = Negative(Value=multiplication_4)
rotax_4 = RotateAxis(Geometry=filter_15, Angle=neg_7, Axis=line_11)  # -> simplify(Geometry), Transform

# ----
data_to_match_7 = Data(split_7.Positive)
planes_to_match_with_7 = Tree(rotax_4.Geometry)

# ---- group: Curve Profile DM
data_to_match_8 = Data(data_to_match_7)
planes_to_match_with_8 = Tree(planes_to_match_with_7)
branch_count_12 = Number(branch_count_11)
group_7 = Group(Objects=data_to_match_8)
dup_21 = DuplicateData(Data=simplify(group_7), Number=branch_count_12, Order=True)
tstat_17 = TreeStatistics(Tree=planes_to_match_with_8)  # -> Paths, Length, Count
graft_32 = GraftTree(Tree=dup_21, IncludeEmptyLists=True, IncludeNullItems=True)
graft_33 = GraftTree(Tree=tstat_17.Length, IncludeEmptyLists=True, IncludeNullItems=True)
dup_22 = DuplicateData(Data=graft_32, Number=graft_33, Order=True)
graft_34 = GraftTree(Tree=dup_22, IncludeEmptyLists=True, IncludeNullItems=True)
ungroup_7 = Ungroup(Group=graft_34)  # -> simplify(Objects)

# ---- group: Frames DM
data_to_match_9 = Data(split_8.Positive)
branch_count_13 = Number(branch_count_11)
planes_to_match_with_9 = Tree(planes_to_match_with_7)
group_8 = Group(Objects=data_to_match_9)
dup_23 = DuplicateData(Data=simplify(group_8), Number=branch_count_13, Order=True)
tstat_18 = TreeStatistics(Tree=planes_to_match_with_9)  # -> Paths, Length, Count
graft_35 = GraftTree(Tree=dup_23, IncludeEmptyLists=True, IncludeNullItems=True)
graft_36 = GraftTree(Tree=tstat_18.Length, IncludeEmptyLists=True, IncludeNullItems=True)
dup_24 = DuplicateData(Data=graft_35, Number=graft_36, Order=True)
graft_37 = GraftTree(Tree=dup_24, IncludeEmptyLists=True, IncludeNullItems=True)
ungroup_8 = Ungroup(Group=graft_37)  # -> simplify(Objects)

# ---- group: Rotation Values DM
profile_curves_to_match_with_4 = Data(data_to_match_7)
plane_to_match_with_4 = Tree(planes_to_match_with_7)
rotation_value_4 = Number(item_3.Item2)
tstat_19 = TreeStatistics(Tree=plane_to_match_with_4)  # -> Paths, Length, Count
tstat_20 = TreeStatistics(Tree=profile_curves_to_match_with_4)  # -> Paths, Length, Count
item_20 = ListItem(List=tstat_20.Length, Index=0, Wrap=True)

# ----
expression_10 = Expression(x=tstat_19.Length, Expression="x-1")
range_12 = Range(Domain=rotation_value_4, Steps=expression_10)
graft_38 = GraftTree(Tree=range_12, IncludeEmptyLists=True, IncludeNullItems=True)

# ---- group: Rotation Values DM (continued)
dup_25 = DuplicateData(Data=graft_38, Number=item_20, Order=True)
neg_8 = Negative(Value=dup_25)
merge_4 = Merge(Data1=dup_25, Data2=neg_8)  # -> simplify(Result)

# ---- group: Profile Curve Placement
frames_from_profile_curves_4 = Plane(ungroup_8)
rotation_values_4 = Number(merge_4)
profile_curves_4 = Curve(ungroup_7)
branch_frames_7 = Plane(planes_to_match_with_7)
graft_39 = GraftTree(Tree=branch_frames_7, IncludeEmptyLists=True, IncludeNullItems=True)
pl_origin_4 = PlaneOrigin(Base=frames_from_profile_curves_4, Origin=graft_39)
prot_8 = RotatePlane(Plane=pl_origin_4, Angle=rotation_values_4)
padjust_4 = AdjustPlane(Plane=prot_8, Normal=graft_39)
orient_4 = Orient(Geometry=profile_curves_4, Source=frames_from_profile_curves_4, Target=padjust_4)  # -> Geometry, Transform

# ---- group: Curve intersection recurtion
crv_19 = Curve(orient_4.Geometry)
lng_4 = ListLength(List=crv_19)
logn = LogN(Number=lng_4, Base=2)  # -> expr("x-1", Result)
item_21 = ListItem(List=flatten(logn), Index=0, Wrap=True)
fastloopstart_4 = FastLoopStart(Iterations=item_21, Data=crv_19)  # -> port, Counter, Data
partition_4 = PartitionList(List=fastloopstart_4.Data, Size="2")
item_22 = ListItem(List=partition_4, Index=0, Wrap=True)  # -> Item, Item1
rint_4 = RegionIntersection(CurvesA=item_22.Item, CurvesB=item_22.Item1)  # -> simplify(Result)
shift_11 = ShiftPaths(Data=rint_4, Offset=-1)
fastloopend_4 = FastLoopEnd(port=fastloopstart_4.port, Exit=False, Data=shift_11, RecordData=False, TimeOutVal=0)  # -> graft(Data)

# ---- group: Sweep Column
branch_frames_8 = Plane(rotax_4.Geometry)
intersected_curves = Curve(fastloopend_4)
graft_40 = GraftTree(Tree=branch_frames_8, IncludeEmptyLists=True, IncludeNullItems=True)
deplane_8 = DeconstructPlane(Plane=graft_40)  # -> Origin, XAxis, YAxis, ZAxis
line_12 = LineSDL(Start=deplane_8.Origin, Direction=deplane_8.XAxis, Length="1000")
ccx_4 = CurveCurve(CurveA=intersected_curves, CurveB=line_12)  # -> Points, ParamsA, ParamsB
seam_4 = Seam(Curve=intersected_curves, Seam=ccx_4.ParamsA)  # -> simplify(Curve)
shift_12 = ShiftPaths(Data=seam_4, Offset=-1)

# ----
tstat_21 = TreeStatistics(Tree=shift_12)  # -> Paths, Length, Count
item_23 = ListItem(List=tstat_21.Paths, Index=0, Wrap=True)
concat = Concatenate(FragmentA=item_23, FragmentB="(+1)")

# ---- group: Sweep Column (continued)
relitem_4 = RelativeItem(Tree=simplify(shift_12), Offset=concat, WrapPaths=False, WrapItems=False)  # -> ItemA, ItemB
end_11 = EndPoints(Curve=relitem_4.ItemA)  # -> Start, End
end_12 = EndPoints(Curve=relitem_4.ItemB)  # -> Start, End
ln_4 = Line(StartPoint=end_11.Start, EndPoint=end_12.Start)
swp2_4 = Sweep2(
    Rail1=reparameterize(graft(relitem_4.ItemA)),
    Rail2=reparameterize(graft(relitem_4.ItemB)),
    Sections=reparameterize(graft(ln_4)),
    SameHeight=False)  # -> simplify(Brep)
pshift = ShiftPaths(Data=swp2_4, Offset=-1)

# ---- group: column visualization
brep_4 = Brep(pshift)
mesh_4 = MeshBrep(
    Brep=brep_4,
    Settings={GridMaxCount=0, GridMinCount=16, JaggedSeams=False, MaxEdgeLength=0, MinEdgeLength=0.0001, MinTolerance=0, Refine=True, RefineAngle=0, RelativeTolerance=0.65, SimplePlanes=True, Tolerance=0})  # -> simplify(Mesh)
mjoin_4 = MeshJoin(Meshes=mesh_4)

# ---- group: Mesh loft visualization
crv_20 = Curve(shift_12)
mloft_4 = MeshLoft(Curves=crv_20, Segments=300)
wbjoin_4 = WeaverbirdsJoinMeshesAndWeld(Mesh=mloft_4, Weld=invert(False))

# ----
filter_16 = StreamFilter(Gate=list_10, Stream0=mjoin_4, Stream1=wbjoin_4)
preview_7 = CustomPreview(Geometry=filter_16, Shader=material_4)

# ==== cluster Cluster
type_of_curve = ClusterInput()  # 0 for line, 1 for curve
branch_count = ClusterInput()
branch_lenght = ClusterInput()  # Linear lenght
branch_rotation = ClusterInput()  # plane rotation for branches
z_axis_rotation = ClusterInput()  # Branch inclination
base_plane = ClusterInput()  # Insert plane to branch off

# ---- group: Branch Curves
num = Number(branch_rotation)
G = Gate(type_of_curve)
pln = Plane(base_plane)
num_2 = Number(z_axis_rotation)
num_3 = Number(branch_lenght)
num_4 = Number(branch_count)
pi = Pi(Factor="2")
range = Range(Domain=pi, Steps=num_4)
pi_2 = Pi(Factor=num)
item = ListItem(List=pln, Index=0, Wrap=True)
shift = ShiftList(List=range, Shift="-1", Wrap=invert(True))
prot = RotatePlane(Plane=item, Angle=pi_2)
pi_3 = Pi(Factor=num_2)
pt = PointPolar(BasePlane=prot, XYAngle=shift, ZAngle=pi_3, Offset=num_3)
vec2pt = Vector2Pt(PointA=prot, PointB=pt, Unitize=False)  # -> Vector, Length
line = LineSDL(Start=prot, Direction=vec2pt.Vector, Length=vec2pt.Length)
end = EndPoints(Curve=line)  # -> Start, End
arc = ArcSED(Start=end.Start, End=end.End, Direction=prot)  # -> Arc, Plane, Radius
filter = StreamFilter(Gate=G, Stream0=line, Stream1=arc.Arc)
pln_2 = Plane(prot)
vec = Vector(vec2pt.Vector)

# ----
base_plane_2 = ClusterOutput(pln_2)  # Branch base plane
guide_vectors = ClusterOutput(vec)  # branch curve direction
branch_curves_crv = ClusterOutput(filter)  # branched curves

# ==== cluster Cluster_2
type_of_plane = ClusterInput()  # 0 for perdendicular frames, 1 for horizontal frames
branch_curves = ClusterInput()  # Insert cuves for section planes
guide_vector_s = ClusterInput()  # Curve guide Vectors
plane_section_count = ClusterInput()  # Curve plane section count
branch_base_plane_pl = ClusterInput()  # Branch base plane
rotation_transition_0_to_1 = ClusterInput()  # First rotation transition. From 0 to 1
rotation_transition_0_to_1_2 = ClusterInput()  # Second rotation transition. From 0 to 1

# ---- group: Branch Frames
G = Gate(type_of_plane)
crv = Curve(branch_curves)
pln = Plane(branch_base_plane_pl)
num = Number(rotation_transition_0_to_1)
num_2 = Number(rotation_transition_0_to_1_2)
num_3 = Number(plane_section_count)
vec = Vector(guide_vector_s)
expression = Expression(x=num_3, Expression="x-1")
project = Project(Geometry=vec, Plane=pln)  # -> Geometry, Transform
cp = ControlPoints(Curve=crv)  # -> Points, Weights, Knots
pframes = PerpFrames(Curve=crv, Count=expression, Align=True)  # -> simplify(Frames), Parameters
lng = ListLength(List=cp.Points)
hframes = HorizontalFrames(Curve=crv, Count=expression)  # -> Frames, Parameters
lng_2 = ListLength(List=crv)
expression_2 = Expression(x=lng, Expression="if(x=2,0,1)")
dup = DuplicateData(Data=pln, Number=lng_2, Order=True)
align = AlignPlane(Plane=pframes.Frames, Direction=graft(project.Geometry))  # -> simplify(Plane), Angle
align_2 = AlignPlane(Plane=hframes.Frames, Direction=vec)  # -> simplify(Plane), Angle
graft = GraftTree(Tree=dup, IncludeEmptyLists=True, IncludeNullItems=True)
lng_3 = ListLength(List=align.Plane)
dup_2 = DuplicateData(Data=expression_2, Number=lng_3, Order=True)
p_n_c = PickNChoose(Pattern=dup_2, Stream0=align_2.Plane, Stream1=hframes.Frames)
p_n_c_2 = PickNChoose(Pattern=dup_2, Stream0=align.Plane, Stream1=pframes.Frames)
filter = StreamFilter(Gate=G, Stream0=p_n_c_2, Stream1=p_n_c)
dom = ConstructDomain(DomainStart=num, DomainEnd=num_2)
range = Range(Domain=dom, Steps=expression)
deplane = DeconstructPlane(Plane=filter)  # -> Origin, XAxis, YAxis, ZAxis
angle = Angle(VectorA=filter, VectorB=graft)  # -> Angle, Reflex
line = LineSDL(Start=deplane.Origin, Direction=deplane.YAxis, Length=1000)
multiplication = Multiplication(A=angle.Angle, B=range)
neg = Negative(Value=multiplication)
rotax = RotateAxis(Geometry=filter, Angle=neg, Axis=line)  # -> simplify(Geometry), Transform

# ----
branch_frames_pl = ClusterOutput(rotax.Geometry)  # Branch Frames from Curves

# ==== cluster Cluster_3
branch_profile_curve_to_match_crv = ClusterInput()  # Profile Curve to Match
branch_count = ClusterInput()  # Branch Count
frames_from_profile_curves_to_match_pl = ClusterInput()  # Frames from Profile Curves to Match
planes_to_match_profile_with = ClusterInput()  # Planes to match Profile with
total_rotation_radians = ClusterInput()
data_to_match = Data(branch_profile_curve_to_match_crv)
planes_to_match_with = Tree(planes_to_match_profile_with)
branch_count_2 = Number(branch_count)

# ---- group: Curve Profile DM
data_to_match_2 = Data(data_to_match)
branch_count_3 = Number(branch_count_2)
planes_to_match_with_2 = Tree(planes_to_match_with)
group = Group(Objects=data_to_match_2)
dup = DuplicateData(Data=simplify(group), Number=branch_count_3, Order=True)
tstat = TreeStatistics(Tree=planes_to_match_with_2)  # -> Paths, Length, Count
graft = GraftTree(Tree=dup, IncludeEmptyLists=True, IncludeNullItems=True)
graft_2 = GraftTree(Tree=tstat.Length, IncludeEmptyLists=True, IncludeNullItems=True)
dup_2 = DuplicateData(Data=graft, Number=graft_2, Order=True)
graft_3 = GraftTree(Tree=dup_2, IncludeEmptyLists=True, IncludeNullItems=True)
ungroup = Ungroup(Group=graft_3)  # -> simplify(Objects)

# ---- group: Frames DM
data_to_match_3 = Data(frames_from_profile_curves_to_match_pl)
planes_to_match_with_3 = Tree(planes_to_match_with)
branch_count_4 = Number(branch_count_2)
group_2 = Group(Objects=data_to_match_3)
dup_3 = DuplicateData(Data=simplify(group_2), Number=branch_count_4, Order=True)
tstat_2 = TreeStatistics(Tree=planes_to_match_with_3)  # -> Paths, Length, Count
graft_4 = GraftTree(Tree=dup_3, IncludeEmptyLists=True, IncludeNullItems=True)
graft_5 = GraftTree(Tree=tstat_2.Length, IncludeEmptyLists=True, IncludeNullItems=True)
dup_4 = DuplicateData(Data=graft_4, Number=graft_5, Order=True)
graft_6 = GraftTree(Tree=dup_4, IncludeEmptyLists=True, IncludeNullItems=True)
ungroup_2 = Ungroup(Group=graft_6)  # -> simplify(Objects)

# ---- group: Rotation Values DM
profile_curves_to_match_with = Data(data_to_match)
plane_to_match_with = Tree(planes_to_match_with)
rotation_value = Number(total_rotation_radians)
tstat_3 = TreeStatistics(Tree=plane_to_match_with)  # -> Paths, Length, Count
tstat_4 = TreeStatistics(Tree=profile_curves_to_match_with)  # -> Paths, Length, Count
item = ListItem(List=tstat_4.Length, Index=0, Wrap=True)

# ----
expression = Expression(x=tstat_3.Length, Expression="x-1")
range = Range(Domain=rotation_value, Steps=expression)
graft_7 = GraftTree(Tree=range, IncludeEmptyLists=True, IncludeNullItems=True)

# ---- group: Rotation Values DM (continued)
dup_5 = DuplicateData(Data=graft_7, Number=item, Order=True)
neg = Negative(Value=dup_5)
merge = Merge(Data1=dup_5, Data2=neg)  # -> simplify(Result)

# ---- group: Profile Curve Placement
frames_from_profile_curves = Plane(ungroup_2)
profile_curves = Curve(ungroup)
rotation_values = Number(merge)
branch_frames = Plane(planes_to_match_with)
graft_8 = GraftTree(Tree=branch_frames, IncludeEmptyLists=True, IncludeNullItems=True)
pl_origin = PlaneOrigin(Base=frames_from_profile_curves, Origin=graft_8)
prot = RotatePlane(Plane=pl_origin, Angle=rotation_values)
padjust = AdjustPlane(Plane=prot, Normal=graft_8)
orient = Orient(Geometry=profile_curves, Source=frames_from_profile_curves, Target=padjust)  # -> Geometry, Transform

# ---- group: Curve intersection recurtion
crv = Curve(orient.Geometry)
lng = ListLength(List=crv)
logn = LogN(Number=lng, Base=2)  # -> expr("x-1", Result)
item_2 = ListItem(List=flatten(logn), Index=0, Wrap=True)
fastloopstart = FastLoopStart(Iterations=item_2, Data=crv)  # -> port, Counter, Data
partition = PartitionList(List=fastloopstart.Data, Size="2")
item_3 = ListItem(List=partition, Index=0, Wrap=True)  # -> Item, Item1
rint = RegionIntersection(CurvesA=item_3.Item, CurvesB=item_3.Item1)  # -> simplify(Result)
shift = ShiftPaths(Data=rint, Offset=-1)
fastloopend = FastLoopEnd(port=fastloopstart.port, Exit=False, Data=shift, RecordData=False, TimeOutVal=0)  # -> graft(Data)

# ----
intersected_curves_crv = ClusterOutput(fastloopend)
profile_curves_crv = ClusterOutput(orient.Geometry)
frames_from_profile_curves_pl = ClusterOutput(padjust)  # Frames from Profile Curves

# ==== cluster Cluster_4
intersected_curves_crv = ClusterInput()  # Intersected Profile Cruves to create Geometry
branch_frames_pl = ClusterInput()  # Branch frames from curves
mesh_visualization = ClusterInput()  # 0 for mesh from sweep, 1 for mesh loft
S = ClusterInput()

# ---- group: Sweep Column
branch_frames = Plane(branch_frames_pl)
intersected_curves = Curve(intersected_curves_crv)
graft = GraftTree(Tree=branch_frames, IncludeEmptyLists=True, IncludeNullItems=True)
deplane = DeconstructPlane(Plane=graft)  # -> Origin, XAxis, YAxis, ZAxis
line = LineSDL(Start=deplane.Origin, Direction=deplane.XAxis, Length="1000")
ccx = CurveCurve(CurveA=intersected_curves, CurveB=line)  # -> Points, ParamsA, ParamsB
seam = Seam(Curve=intersected_curves, Seam=ccx.ParamsA)  # -> simplify(Curve)
shift = ShiftPaths(Data=seam, Offset=-1)

# ----
tstat = TreeStatistics(Tree=shift)  # -> Paths, Length, Count
item = ListItem(List=tstat.Paths, Index=0, Wrap=True)
concat = Concatenate(FragmentA=item, FragmentB="(+1)")

# ---- group: Sweep Column (continued)
relitem = RelativeItem(Tree=simplify(shift), Offset=concat, WrapPaths=False, WrapItems=False)  # -> ItemA, ItemB
end = EndPoints(Curve=relitem.ItemA)  # -> Start, End
end_2 = EndPoints(Curve=relitem.ItemB)  # -> Start, End
ln = Line(StartPoint=end.Start, EndPoint=end_2.Start)
swp2 = Sweep2(
    Rail1=reparameterize(graft(relitem.ItemA)),
    Rail2=reparameterize(graft(relitem.ItemB)),
    Sections=reparameterize(graft(ln)),
    SameHeight=False)  # -> simplify(Brep)
pshift = ShiftPaths(Data=swp2, Offset=-1)

# ---- group: Mesh loft visualization
crv = Curve(shift)
mloft = MeshLoft(Curves=crv, Segments=300)
wbjoin = WeaverbirdsJoinMeshesAndWeld(Mesh=mloft, Weld=invert(False))

# ---- group: column visualization
brep = Brep(pshift)
mesh = MeshBrep(
    Brep=brep,
    Settings={GridMaxCount=0, GridMinCount=16, JaggedSeams=False, MaxEdgeLength=0, MinEdgeLength=0.0001, MinTolerance=0, Refine=True, RefineAngle=0, RelativeTolerance=0.65, SimplePlanes=True, Tolerance=0})  # -> simplify(Mesh)
mjoin = MeshJoin(Meshes=mesh)

# ----
filter = StreamFilter(Gate=mesh_visualization, Stream0=mjoin, Stream1=wbjoin)
sweep_surface = ClusterOutput(pshift)  # Sweep surface from Instersected Curves
mesh_from_intersected_curves_m = ClusterOutput(filter)  # Mesh from intersected curves
preview = CustomPreview(Geometry=filter, Shader=S)

# ==== cluster Cluster_5
profile_curves_from_branch_crv = ClusterInput()  # Profile curves to choose from
profile_curve_frames_from_branch_pl = ClusterInput()  # Profile Curve Frames from Branch to choose from
branch_path_int = ClusterInput()  # Connect integers numbers to create branch path
branch_item_selection_0_1 = ClusterInput()  # 0 to use last branch item, 1 to select branch item

# ---- group: branch sorting
crv = Curve(simplify(profile_curves_from_branch_crv))
pln = Plane(simplify(profile_curve_frames_from_branch_pl))
int = Integer(branch_item_selection_0_1)
int_2 = Integer(branch_path_int)
tstat = TreeStatistics(Tree=crv)  # -> Paths, Length, Count
item = ListItem(List=reverse(tstat.Paths), Index=0, Wrap=True)
dpath = DeconstructPath(Branch=item)
sort = SortList(Keys=dpath)  # -> reverse(Keys), ValuesA
item_2 = ListItem(List=sort.Keys, Index=0, Wrap=True)
path_mask = Panel("{*;x;*}")
to_replace = Panel("x")
int_3 = Integer(item_2)
rep = ReplaceText(Text=path_mask, Find=to_replace, Replace=int_3, RecursiveReplace=False)
path = ConstructPath(Indices=int_2)

# ----
filter = StreamFilter(Gate=int, Stream0=rep, Stream1=path)

# ---- group: branch sorting (continued)
split = SplitTree(Data=crv, Masks=flatten(filter))  # -> Positive, Negative
split_2 = SplitTree(Data=pln, Masks=flatten(filter))  # -> Positive, Negative

# ----
selected_profile_curves = ClusterOutput(split.Positive)  # Selected Profile Curves
selected_profile_curve_frames = ClusterOutput(split_2.Positive)  # Selected Profile Curve Frames
selected_path_tree_index = ClusterOutput(filter)  # Selected Path (Tree Index)
