# Grasshopper definition Digital Column 3.0 (curve).gh (Grasshopper 0.9.76)

number_slider = Slider(3, range=3..8)

# ---- group: ROTATION VALUES / levels
series = Series(Start="2", Step=1, Count=Slider(4, range=1..5))

# ----
xy = XYPlane(Origin=Point(0, 0, 0))
list = ValueList({"From Last Branch Item": 0, "Select Branch Item": 1}, selected="From Last Branch Item")

# ---- group: ROTATION VALUES / circumference
pi = Pi(Factor=2)

# ---- group: ROTATION VALUES
profile_curve_sides = Panel(number_slider)
expression = Expression(x=pi, y=profile_curve_sides, z=series, Expression="(x/y)/(2^z)")
panel = Panel(expression)
item = ListItem(List=expression, Index=0, Wrap=True)  # -> Item, Item1, Item2, Item3

# ----
polygon = Polygon(Plane=xy, Radius=Slider(350, range=0..1000), Segments=number_slider, FilletRadius=0)  # -> Polygon, Length
branch_rotation = Slider(0, range=0..2)
branch_count = Slider(1, range=1..6)
frame_count = Slider(20, range=5..20)
distance = Slider(2374, range=0..3000)
z_angle = Slider(0.5, range=0..0.5)
list_2 = ValueList({"Perpendicular Frame": 0, "Horizontal Frame": 1}, selected="Perpendicular Frame")
cluster = Cluster_5(profile_curves_from_branch_crv=polygon.Polygon, profile_curve_frames_from_branch_pl=xy, branch_item_selection_0_1=0)  # -> selected_profile_curves, selected_profile_curve_frames, selected_path_tree_index
list_3 = ValueList({"Line": 0, "Curve": 1}, selected="Line")
cluster_2 = Cluster(
    type_of_curve=list_3,
    base_plane=cluster.selected_profile_curve_frames,
    branch_count=branch_count,
    branch_lenght=distance,
    branch_rotation=branch_rotation,
    z_axis_rotation=z_angle)  # -> branch_curves_crv, guide_vectors, base_plane_2
cluster_3 = Cluster_2(
    type_of_plane=list_2,
    branch_curves=cluster_2.branch_curves_crv,
    guide_vector_s=cluster_2.guide_vectors,
    plane_section_count=frame_count,
    branch_base_plane_pl=cluster_2.base_plane_2,
    rotation_transition_0_to_1=Slider(1, range=0..1),
    rotation_transition_0_to_1_2=Slider(0, range=0..1))
cluster_4 = Cluster_3(
    branch_profile_curve_to_match_crv=cluster.selected_profile_curves,
    branch_count=branch_count,
    frames_from_profile_curves_to_match_pl=cluster.selected_profile_curve_frames,
    planes_to_match_profile_with=cluster_3,
    total_rotation_radians=item.Item)  # -> intersected_curves_crv, profile_curves_crv, frames_from_profile_curves_pl
branch_rotation_2 = Slider(0.25, range=0..2)
branch_count_2 = Slider(3, range=1..6)
frame_count_2 = Slider(20, range=5..20)
distance_2 = Slider(2374, range=0..3000)
z_angle_2 = Slider(0.353, range=0..0.5)
list_4 = ValueList({"Perpendicular Frame": 0, "Horizontal Frame": 1}, selected="Perpendicular Frame")
cluster_5 = Cluster_5(
    profile_curves_from_branch_crv=cluster_4.profile_curves_crv,
    profile_curve_frames_from_branch_pl=cluster_4.frames_from_profile_curves_pl,
    branch_item_selection_0_1=0)  # -> selected_profile_curves, selected_profile_curve_frames, selected_path_tree_index
list_5 = ValueList({"Line": 0, "Curve": 1}, selected="Curve")
cluster_6 = Cluster(
    type_of_curve=list_5,
    base_plane=cluster_5.selected_profile_curve_frames,
    branch_count=branch_count_2,
    branch_lenght=distance_2,
    branch_rotation=branch_rotation_2,
    z_axis_rotation=z_angle_2)  # -> branch_curves_crv, guide_vectors, base_plane_2
cluster_7 = Cluster_2(
    type_of_plane=list_4,
    branch_curves=cluster_6.branch_curves_crv,
    guide_vector_s=cluster_6.guide_vectors,
    plane_section_count=frame_count_2,
    branch_base_plane_pl=cluster_6.base_plane_2,
    rotation_transition_0_to_1=Slider(1, range=0..1),
    rotation_transition_0_to_1_2=Slider(0, range=0..1))
cluster_8 = Cluster_3(
    branch_profile_curve_to_match_crv=cluster_5.selected_profile_curves,
    branch_count=branch_count_2,
    frames_from_profile_curves_to_match_pl=cluster_5.selected_profile_curve_frames,
    planes_to_match_profile_with=cluster_7,
    total_rotation_radians=item.Item1)  # -> intersected_curves_crv, profile_curves_crv, frames_from_profile_curves_pl
branch_rotation_3 = Slider(0.25, range=0..2)
branch_count_3 = Slider(3, range=1..6)
frame_count_3 = Slider(20, range=5..20)
distance_3 = Slider(2374, range=0..3000)
z_angle_3 = Slider(0.353, range=0..0.5)
list_6 = ValueList({"Perpendicular Frame": 0, "Horizontal Frame": 1}, selected="Perpendicular Frame")
cluster_9 = Cluster_5(
    profile_curves_from_branch_crv=cluster_8.profile_curves_crv,
    profile_curve_frames_from_branch_pl=cluster_8.frames_from_profile_curves_pl,
    branch_item_selection_0_1=0)  # -> selected_profile_curves, selected_profile_curve_frames, selected_path_tree_index
list_7 = ValueList({"Line": 0, "Curve": 1}, selected="Curve")
cluster_10 = Cluster(
    type_of_curve=list_7,
    base_plane=cluster_9.selected_profile_curve_frames,
    branch_count=branch_count_3,
    branch_lenght=distance_3,
    branch_rotation=branch_rotation_3,
    z_axis_rotation=z_angle_3)  # -> branch_curves_crv, guide_vectors, base_plane_2
cluster_11 = Cluster_2(
    type_of_plane=list_6,
    branch_curves=cluster_10.branch_curves_crv,
    guide_vector_s=cluster_10.guide_vectors,
    plane_section_count=frame_count_3,
    branch_base_plane_pl=cluster_10.base_plane_2,
    rotation_transition_0_to_1=Slider(1, range=0..1),
    rotation_transition_0_to_1_2=Slider(0, range=0..1))
list_8 = ValueList({"Mesh from Sweep": 0, "Mesh Loft": 1}, selected="Mesh from Sweep")
cluster_12 = Cluster_3(
    branch_profile_curve_to_match_crv=cluster_9.selected_profile_curves,
    branch_count=branch_count_3,
    frames_from_profile_curves_to_match_pl=cluster_9.selected_profile_curve_frames,
    planes_to_match_profile_with=cluster_11,
    total_rotation_radians=item.Item2)  # -> intersected_curves_crv, profile_curves_crv, frames_from_profile_curves_pl
cluster_13 = Cluster_4(
    mesh_visualization=list_8,
    intersected_curves_crv=cluster_8.intersected_curves_crv,
    branch_frames_pl=cluster_7,
    S={ambient=RGB(0, 0, 0), diffuse=RGB(255, 105, 180), emission=RGB(76, 32, 54), shine=0.5, specular=RGB(255, 255, 255), transparency=0})  # -> sweep_surface, mesh_from_intersected_curves_m
cluster_14 = Cluster_4(
    mesh_visualization=list_8,
    intersected_curves_crv=cluster_4.intersected_curves_crv,
    branch_frames_pl=cluster_3,
    S={ambient=RGB(0, 0, 0), diffuse=RGB(255, 105, 180), emission=RGB(76, 32, 54), shine=0.5, specular=RGB(255, 255, 255), transparency=0})  # -> sweep_surface, mesh_from_intersected_curves_m
cluster_15 = Cluster_4(
    mesh_visualization=list_8,
    intersected_curves_crv=cluster_12.intersected_curves_crv,
    branch_frames_pl=cluster_11,
    S={ambient=RGB(0, 0, 0), diffuse=RGB(255, 105, 180), emission=RGB(76, 32, 54), shine=0.5, specular=RGB(255, 255, 255), transparency=0})  # -> sweep_surface, mesh_from_intersected_curves_m
material = CreateMaterial(
    Diffuse=ColourSwatch(SwatchColor=RGB(230, 73, 73)),
    Specular=RGB(255, 255, 255),
    Emission=RGB(0, 0, 0),
    Transparency=0,
    Shine=Slider(24, range=0..100))
preview = CustomPreview(
    Geometry=[cluster_14.mesh_from_intersected_curves_m, cluster_13.mesh_from_intersected_curves_m, cluster_15.mesh_from_intersected_curves_m],
    Shader=material)

# ==== cluster Cluster
type_of_curve = ClusterInput()  # 0 for line, 1 for curve
branch_count = ClusterInput()
branch_lenght = ClusterInput()  # Linear lenght
branch_rotation = ClusterInput()  # plane rotation for branches
z_axis_rotation = ClusterInput()  # Branch inclination
base_plane = ClusterInput()  # Insert plane to branch off

# ---- group: Branch Curves
num = Number(branch_rotation)
G = Gate(type_of_curve)
pln = Plane(base_plane)
num_2 = Number(z_axis_rotation)
num_3 = Number(branch_lenght)
num_4 = Number(branch_count)
pi = Pi(Factor="2")
range = Range(Domain=pi, Steps=num_4)
pi_2 = Pi(Factor=num)
item = ListItem(List=pln, Index=0, Wrap=True)
shift = ShiftList(List=range, Shift="-1", Wrap=invert(True))
prot = RotatePlane(Plane=item, Angle=pi_2)
pi_3 = Pi(Factor=num_2)
pt = PointPolar(BasePlane=prot, XYAngle=shift, ZAngle=pi_3, Offset=num_3)
vec2pt = Vector2Pt(PointA=prot, PointB=pt, Unitize=False)  # -> Vector, Length
line = LineSDL(Start=prot, Direction=vec2pt.Vector, Length=vec2pt.Length)
end = EndPoints(Curve=line)  # -> Start, End
arc = ArcSED(Start=end.Start, End=end.End, Direction=prot)  # -> Arc, Plane, Radius
filter = StreamFilter(Gate=G, Stream0=line, Stream1=arc.Arc)
pln_2 = Plane(prot)
vec = Vector(vec2pt.Vector)

# ----
base_plane_2 = ClusterOutput(pln_2)  # Branch base plane
guide_vectors = ClusterOutput(vec)  # branch curve direction
branch_curves_crv = ClusterOutput(filter)  # branched curves

# ==== cluster Cluster_2
type_of_plane = ClusterInput()  # 0 for perdendicular frames, 1 for horizontal frames
branch_curves = ClusterInput()  # Insert cuves for section planes
guide_vector_s = ClusterInput()  # Curve guide Vectors
plane_section_count = ClusterInput()  # Curve plane section count
branch_base_plane_pl = ClusterInput()  # Branch base plane
rotation_transition_0_to_1 = ClusterInput()  # First rotation transition. From 0 to 1
rotation_transition_0_to_1_2 = ClusterInput()  # Second rotation transition. From 0 to 1

# ---- group: Branch Frames
G = Gate(type_of_plane)
crv = Curve(branch_curves)
pln = Plane(branch_base_plane_pl)
num = Number(rotation_transition_0_to_1)
num_2 = Number(rotation_transition_0_to_1_2)
num_3 = Number(plane_section_count)
vec = Vector(guide_vector_s)
expression = Expression(x=num_3, Expression="x-1")
project = Project(Geometry=vec, Plane=pln)  # -> Geometry, Transform
cp = ControlPoints(Curve=crv)  # -> Points, Weights, Knots
pframes = PerpFrames(Curve=crv, Count=expression, Align=True)  # -> simplify(Frames), Parameters
lng = ListLength(List=cp.Points)
hframes = HorizontalFrames(Curve=crv, Count=expression)  # -> Frames, Parameters
lng_2 = ListLength(List=crv)
expression_2 = Expression(x=lng, Expression="if(x=2,0,1)")
dup = DuplicateData(Data=pln, Number=lng_2, Order=True)
align = AlignPlane(Plane=pframes.Frames, Direction=graft(project.Geometry))  # -> simplify(Plane), Angle
align_2 = AlignPlane(Plane=hframes.Frames, Direction=vec)  # -> simplify(Plane), Angle
graft = GraftTree(Tree=dup, IncludeEmptyLists=True, IncludeNullItems=True)
lng_3 = ListLength(List=align.Plane)
dup_2 = DuplicateData(Data=expression_2, Number=lng_3, Order=True)
p_n_c = PickNChoose(Pattern=dup_2, Stream0=align_2.Plane, Stream1=hframes.Frames)
p_n_c_2 = PickNChoose(Pattern=dup_2, Stream0=align.Plane, Stream1=pframes.Frames)
filter = StreamFilter(Gate=G, Stream0=p_n_c_2, Stream1=p_n_c)
dom = ConstructDomain(DomainStart=num, DomainEnd=num_2)
range = Range(Domain=dom, Steps=expression)
deplane = DeconstructPlane(Plane=filter)  # -> Origin, XAxis, YAxis, ZAxis
angle = Angle(VectorA=filter, VectorB=graft)  # -> Angle, Reflex
line = LineSDL(Start=deplane.Origin, Direction=deplane.YAxis, Length=1000)
multiplication = Multiplication(A=angle.Angle, B=range)
neg = Negative(Value=multiplication)
rotax = RotateAxis(Geometry=filter, Angle=neg, Axis=line)  # -> simplify(Geometry), Transform

# ----
branch_frames_pl = ClusterOutput(rotax.Geometry)  # Branch Frames from Curves

# ==== cluster Cluster_3
branch_profile_curve_to_match_crv = ClusterInput()  # Profile Curve to Match
branch_count = ClusterInput()  # Branch Count
frames_from_profile_curves_to_match_pl = ClusterInput()  # Frames from Profile Curves to Match
planes_to_match_profile_with = ClusterInput()  # Planes to match Profile with
total_rotation_radians = ClusterInput()
data_to_match = Data(branch_profile_curve_to_match_crv)
planes_to_match_with = Tree(planes_to_match_profile_with)
branch_count_2 = Number(branch_count)

# ---- group: Curve Profile DM
data_to_match_2 = Data(data_to_match)
branch_count_3 = Number(branch_count_2)
planes_to_match_with_2 = Tree(planes_to_match_with)
group = Group(Objects=data_to_match_2)
dup = DuplicateData(Data=simplify(group), Number=branch_count_3, Order=True)
tstat = TreeStatistics(Tree=planes_to_match_with_2)  # -> Paths, Length, Count
graft = GraftTree(Tree=dup, IncludeEmptyLists=True, IncludeNullItems=True)
graft_2 = GraftTree(Tree=tstat.Length, IncludeEmptyLists=True, IncludeNullItems=True)
dup_2 = DuplicateData(Data=graft, Number=graft_2, Order=True)
graft_3 = GraftTree(Tree=dup_2, IncludeEmptyLists=True, IncludeNullItems=True)
ungroup = Ungroup(Group=graft_3)  # -> simplify(Objects)

# ---- group: Frames DM
data_to_match_3 = Data(frames_from_profile_curves_to_match_pl)
planes_to_match_with_3 = Tree(planes_to_match_with)
branch_count_4 = Number(branch_count_2)
group_2 = Group(Objects=data_to_match_3)
dup_3 = DuplicateData(Data=simplify(group_2), Number=branch_count_4, Order=True)
tstat_2 = TreeStatistics(Tree=planes_to_match_with_3)  # -> Paths, Length, Count
graft_4 = GraftTree(Tree=dup_3, IncludeEmptyLists=True, IncludeNullItems=True)
graft_5 = GraftTree(Tree=tstat_2.Length, IncludeEmptyLists=True, IncludeNullItems=True)
dup_4 = DuplicateData(Data=graft_4, Number=graft_5, Order=True)
graft_6 = GraftTree(Tree=dup_4, IncludeEmptyLists=True, IncludeNullItems=True)
ungroup_2 = Ungroup(Group=graft_6)  # -> simplify(Objects)

# ---- group: Rotation Values DM
profile_curves_to_match_with = Data(data_to_match)
plane_to_match_with = Tree(planes_to_match_with)
rotation_value = Number(total_rotation_radians)
tstat_3 = TreeStatistics(Tree=plane_to_match_with)  # -> Paths, Length, Count
tstat_4 = TreeStatistics(Tree=profile_curves_to_match_with)  # -> Paths, Length, Count
item = ListItem(List=tstat_4.Length, Index=0, Wrap=True)

# ----
expression = Expression(x=tstat_3.Length, Expression="x-1")
range = Range(Domain=rotation_value, Steps=expression)
graft_7 = GraftTree(Tree=range, IncludeEmptyLists=True, IncludeNullItems=True)

# ---- group: Rotation Values DM (continued)
dup_5 = DuplicateData(Data=graft_7, Number=item, Order=True)
neg = Negative(Value=dup_5)
merge = Merge(Data1=dup_5, Data2=neg)  # -> simplify(Result)

# ---- group: Profile Curve Placement
frames_from_profile_curves = Plane(ungroup_2)
profile_curves = Curve(ungroup)
rotation_values = Number(merge)
branch_frames = Plane(planes_to_match_with)
graft_8 = GraftTree(Tree=branch_frames, IncludeEmptyLists=True, IncludeNullItems=True)
pl_origin = PlaneOrigin(Base=frames_from_profile_curves, Origin=graft_8)
prot = RotatePlane(Plane=pl_origin, Angle=rotation_values)
padjust = AdjustPlane(Plane=prot, Normal=graft_8)
orient = Orient(Geometry=profile_curves, Source=frames_from_profile_curves, Target=padjust)  # -> Geometry, Transform

# ---- group: Curve intersection recurtion
crv = Curve(orient.Geometry)
lng = ListLength(List=crv)
logn = LogN(Number=lng, Base=2)  # -> expr("x-1", Result)
item_2 = ListItem(List=flatten(logn), Index=0, Wrap=True)
fastloopstart = FastLoopStart(Iterations=item_2, Data=crv)  # -> port, Counter, Data
partition = PartitionList(List=fastloopstart.Data, Size="2")
item_3 = ListItem(List=partition, Index=0, Wrap=True)  # -> Item, Item1
rint = RegionIntersection(CurvesA=item_3.Item, CurvesB=item_3.Item1)  # -> simplify(Result)
shift = ShiftPaths(Data=rint, Offset=-1)
fastloopend = FastLoopEnd(port=fastloopstart.port, Exit=False, Data=shift, RecordData=False, TimeOutVal=0)  # -> graft(Data)

# ----
intersected_curves_crv = ClusterOutput(fastloopend)
profile_curves_crv = ClusterOutput(orient.Geometry)
frames_from_profile_curves_pl = ClusterOutput(padjust)  # Frames from Profile Curves

# ==== cluster Cluster_4
intersected_curves_crv = ClusterInput()  # Intersected Profile Cruves to create Geometry
branch_frames_pl = ClusterInput()  # Branch frames from curves
mesh_visualization = ClusterInput()  # 0 for mesh from sweep, 1 for mesh loft
S = ClusterInput()

# ---- group: Sweep Column
branch_frames = Plane(branch_frames_pl)
intersected_curves = Curve(intersected_curves_crv)
graft = GraftTree(Tree=branch_frames, IncludeEmptyLists=True, IncludeNullItems=True)
deplane = DeconstructPlane(Plane=graft)  # -> Origin, XAxis, YAxis, ZAxis
line = LineSDL(Start=deplane.Origin, Direction=deplane.XAxis, Length="1000")
ccx = CurveCurve(CurveA=intersected_curves, CurveB=line)  # -> Points, ParamsA, ParamsB
seam = Seam(Curve=intersected_curves, Seam=ccx.ParamsA)  # -> simplify(Curve)
shift = ShiftPaths(Data=seam, Offset=-1)

# ----
tstat = TreeStatistics(Tree=shift)  # -> Paths, Length, Count
item = ListItem(List=tstat.Paths, Index=0, Wrap=True)
concat = Concatenate(FragmentA=item, FragmentB="(+1)")

# ---- group: Sweep Column (continued)
relitem = RelativeItem(Tree=simplify(shift), Offset=concat, WrapPaths=False, WrapItems=False)  # -> ItemA, ItemB
end = EndPoints(Curve=relitem.ItemA)  # -> Start, End
end_2 = EndPoints(Curve=relitem.ItemB)  # -> Start, End
ln = Line(StartPoint=end.Start, EndPoint=end_2.Start)
swp2 = Sweep2(
    Rail1=reparameterize(graft(relitem.ItemA)),
    Rail2=reparameterize(graft(relitem.ItemB)),
    Sections=reparameterize(graft(ln)),
    SameHeight=False)  # -> simplify(Brep)
shift_2 = ShiftPaths(Data=swp2, Offset=-1)

# ---- group: Mesh loft visualization
crv = Curve(shift)
mloft = MeshLoft(Curves=crv, Segments=300)
wbjoin = WeaverbirdsJoinMeshesAndWeld(Mesh=mloft, Weld=invert(False))

# ---- group: column visualization
brep = Brep(shift_2)
mesh = MeshBrep(
    Brep=brep,
    Settings={GridMaxCount=0, GridMinCount=16, JaggedSeams=False, MaxEdgeLength=0, MinEdgeLength=0.0001, MinTolerance=0, Refine=True, RefineAngle=0, RelativeTolerance=0.65, SimplePlanes=True, Tolerance=0})  # -> simplify(Mesh)
mjoin = MeshJoin(Meshes=mesh)

# ----
filter = StreamFilter(Gate=mesh_visualization, Stream0=mjoin, Stream1=wbjoin)
sweep_surface = ClusterOutput(shift_2)  # Sweep surface from Instersected Curves
mesh_from_intersected_curves_m = ClusterOutput(filter)  # Mesh from intersected curves
preview = CustomPreview(Geometry=filter, Shader=S)

# ==== cluster Cluster_5
profile_curves_from_branch_crv = ClusterInput()  # Profile curves to choose from
profile_curve_frames_from_branch_pl = ClusterInput()  # Profile Curve Frames from Branch to choose from
branch_path_int = ClusterInput()  # Connect integers numbers to create branch path
branch_item_selection_0_1 = ClusterInput()  # 0 to use last branch item, 1 to select branch item

# ---- group: branch sorting
int = Integer(branch_item_selection_0_1)
crv = Curve(simplify(profile_curves_from_branch_crv))
pln = Plane(simplify(profile_curve_frames_from_branch_pl))
int_2 = Integer(branch_path_int)
tstat = TreeStatistics(Tree=crv)  # -> Paths, Length, Count
item = ListItem(List=reverse(tstat.Paths), Index=0, Wrap=True)
dpath = DeconstructPath(Branch=item)
sort = SortList(Keys=dpath)  # -> reverse(Keys), ValuesA
item_2 = ListItem(List=sort.Keys, Index=0, Wrap=True)
path_mask = Panel("{*;x;*}")
to_replace = Panel("x")
int_3 = Integer(item_2)
rep = ReplaceText(Text=path_mask, Find=to_replace, Replace=int_3, RecursiveReplace=False)
path = ConstructPath(Indices=int_2)

# ----
filter = StreamFilter(Gate=int, Stream0=rep, Stream1=path)

# ---- group: branch sorting (continued)
split = SplitTree(Data=crv, Masks=flatten(filter))  # -> Positive, Negative
split_2 = SplitTree(Data=pln, Masks=flatten(filter))  # -> Positive, Negative

# ----
selected_profile_curves = ClusterOutput(split.Positive)  # Selected Profile Curves
selected_profile_curve_frames = ClusterOutput(split_2.Positive)  # Selected Profile Curve Frames
selected_path_tree_index = ClusterOutput(filter)  # Selected Path (Tree Index)
