# Grasshopper definition Digital Column 3.0.gh (Grasshopper 0.9.76)

# Multi Level mixed Column
number_slider = Slider(3, range=3..8)  # disabled
# 3 Level Straight Column
number_slider_2 = Slider(3, range=3..8)  # disabled
number_slider_3 = Slider(350, range=0..1000)  # disabled
number_slider_4 = Slider(600, range=0..1000)  # disabled

# ---- group: Gaudi profile curve
oscilations = Slider(16, range=0..20)
# Gaudi Column
resolution = Slider(8, range=0..10)
pi = Pi(Factor=2)
multiplication = Multiplication(A=resolution, B=oscilations)
range = Range(Domain=oscilations, Steps=multiplication)
range_2 = Range(Domain=pi, Steps=multiplication)
pi_2 = Pi(Factor=range)
sin = Sine(Value=pi_2)
bnd = Bounds(Numbers=sin)
dom = ConstructDomain(DomainStart=Slider(319, range=200..500), DomainEnd=Slider(500, range=200..500))
xy = XYPlane(Origin=Point(0, 0, 0))
remap = RemapNumbers(Value=sin, Source=bnd, Target=dom)  # -> Mapped, Clipped
pt = PointCylindrical(BasePlane=xy, Angle=range_2, Radius=remap.Mapped, Elevation=0)
intcrv = Interpolate(Vertices=pt, Degree=3, Periodic=False, KnotStyle=1)  # -> Curve, Length, Domain

# ---- group: ROTATION VALUES / levels
number_slider_5 = Slider(4, range=1..5)  # disabled
panel = Panel("2")  # disabled
series = Series(Start=panel, Step=1, Count=number_slider_5)  # disabled

# ---- group: ADD CURVE HERE
# Multi Level mixed Column
# With Curve from Rhino
xy_2 = XYPlane(Origin=Point(0, 0, 0))  # disabled
crv = Curve(<curve referenced from the Rhino model>)  # disabled

# ----
xy_3 = XYPlane(Origin=Point(0, 0, 0))  # disabled
xy_4 = XYPlane(Origin=Point(0, 0, 0))  # disabled

# ---- group: ROTATION VALUES / levels
number_slider_6 = Slider(4, range=1..5)  # disabled
panel_2 = Panel("2")  # disabled
series_2 = Series(Start=panel_2, Step=1, Count=number_slider_6)  # disabled

number_slider_7 = Slider(4, range=1..5)  # disabled
panel_3 = Panel("2")  # disabled
series_3 = Series(Start=panel_3, Step=1, Count=number_slider_7)  # disabled

# ---- group: ROTATION VALUES / circumference
pi_3 = Pi(Factor=2)  # disabled

# ---- group: ROTATION VALUES
profile_curve_sides = Panel(number_slider)  # disabled
expression = Expression(x=pi_3, y=profile_curve_sides, z=series, Expression="(x/y)/(2^z)")  # disabled
panel_4 = Panel(expression)  # disabled
item = ListItem(List=expression, Index=0, Wrap=True)  # -> Item, Item1, Item2, Item3; disabled

# ----
polygon = Polygon(Plane=xy_3, Radius=number_slider_3, Segments=number_slider, FilletRadius=0)  # -> Polygon, Length; disabled

number_slider_8 = Slider(0, range=0..1)  # disabled
number_slider_9 = Slider(1, range=0..1)  # disabled
branch_rotation = Slider(0, range=0..2)  # disabled
branch_count = Slider(1, range=1..6)  # disabled
frame_count = Slider(20, range=5..20)  # disabled
distance = Slider(2374, range=0..3000)  # disabled
z_angle = Slider(0.5, range=0..0.5)  # disabled
list = ValueList({"Perpendicular Frame": 0, "Horizontal Frame": 1}, selected="Perpendicular Frame")  # disabled
cluster = Cluster_5(profile_curves_from_branch_crv=polygon.Polygon, profile_curve_frames_from_branch_pl=xy_3, branch_item_selection_0_1=0)  # -> selected_profile_curves, selected_profile_curve_frames, selected_path_tree_index; disabled
list_2 = ValueList({"Line": 0, "Curve": 1}, selected="Line")  # disabled
cluster_2 = Cluster(
    type_of_curve=list_2,
    base_plane=cluster.selected_profile_curve_frames,
    branch_count=branch_count,
    branch_lenght=distance,
    branch_rotation=branch_rotation,
    z_axis_rotation=z_angle)  # -> branch_curves_crv, guide_vectors, base_plane_2; disabled
cluster_3 = Cluster_2(
    type_of_plane=list,
    branch_curves=cluster_2.branch_curves_crv,
    guide_vector_s=cluster_2.guide_vectors,
    plane_section_count=frame_count,
    branch_base_plane_pl=cluster_2.base_plane_2,
    rotation_transition_0_to_1=number_slider_9,
    rotation_transition_0_to_1_2=number_slider_8)  # disabled
cluster_4 = Cluster_3(
    branch_profile_curve_to_match_crv=cluster.selected_profile_curves,
    branch_count=branch_count,
    frames_from_profile_curves_to_match_pl=cluster.selected_profile_curve_frames,
    planes_to_match_profile_with=cluster_3,
    total_rotation_radians=item.Item)  # -> profile_curves_crv, frames_from_profile_curves_pl; disabled

polygon_2 = Polygon(Plane=xy_4, Radius=number_slider_4, Segments=number_slider_2, FilletRadius=0)  # -> Polygon, Length; disabled

# ---- group: ROTATION VALUES / circumference
pi_4 = Pi(Factor=2)  # disabled

# ---- group: ROTATION VALUES
profile_curve_sides_2 = Panel(number_slider_2)  # disabled
expression_2 = Expression(x=pi_4, y=profile_curve_sides_2, z=series_2, Expression="(x/y)/(2^z)")  # disabled
panel_5 = Panel(expression_2)  # disabled
item_2 = ListItem(List=expression_2, Index=0, Wrap=True)  # -> Item, Item1, Item2, Item3; disabled

# ---- group: ROTATION VALUES / circumference
pi_5 = Pi(Factor=2)  # disabled

# ---- group: ROTATION VALUES
profile_curve_sides_3 = Panel("4")  # disabled
expression_3 = Expression(x=pi_5, y=profile_curve_sides_3, z=series_3, Expression="(x/y)/(2^z)")  # disabled
panel_6 = Panel(expression_3)  # disabled
item_3 = ListItem(List=expression_3, Index=0, Wrap=True)  # -> Item, Item1, Item2, Item3; disabled

# ----
number_slider_10 = Slider(1, range=0..1)  # disabled
number_slider_11 = Slider(0, range=0..1)  # disabled
branch_rotation_2 = Slider(0, range=0..2)  # disabled
branch_count_2 = Slider(2, range=1..6)  # disabled
frame_count_2 = Slider(20, range=5..20)  # disabled
distance_2 = Slider(3000, range=0..3000)  # disabled
z_angle_2 = Slider(0.35, range=0..0.5)  # disabled
list_3 = ValueList({"Perpendicular Frame": 0, "Horizontal Frame": 1}, selected="Perpendicular Frame")  # disabled
cluster_5 = Cluster_5(profile_curves_from_branch_crv=crv, profile_curve_frames_from_branch_pl=xy_2, branch_item_selection_0_1=0)  # -> selected_profile_curves, selected_profile_curve_frames, selected_path_tree_index; disabled
list_4 = ValueList({"Line": 0, "Curve": 1}, selected="Curve")  # disabled
cluster_6 = Cluster(
    type_of_curve=list_4,
    base_plane=cluster_5.selected_profile_curve_frames,
    branch_count=branch_count_2,
    branch_lenght=distance_2,
    branch_rotation=branch_rotation_2,
    z_axis_rotation=z_angle_2)  # -> branch_curves_crv, guide_vectors, base_plane_2; disabled
cluster_7 = Cluster_2(
    type_of_plane=list_3,
    branch_curves=cluster_6.branch_curves_crv,
    guide_vector_s=cluster_6.guide_vectors,
    plane_section_count=frame_count_2,
    branch_base_plane_pl=cluster_6.base_plane_2,
    rotation_transition_0_to_1=number_slider_10,
    rotation_transition_0_to_1_2=number_slider_11)  # disabled
cluster_8 = Cluster_3(
    branch_profile_curve_to_match_crv=cluster_5.selected_profile_curves,
    branch_count=branch_count_2,
    frames_from_profile_curves_to_match_pl=cluster_5.selected_profile_curve_frames,
    planes_to_match_profile_with=cluster_7,
    total_rotation_radians=item_3.Item)  # -> profile_curves_crv, frames_from_profile_curves_pl; disabled

# ---- group: gaudi column sides
division = Division(A=oscilations, B="2")

# ---- group: ROTATION VALUES / levels
series_4 = Series(Start="2", Step=1, Count=Slider(4, range=1..5))

# ---- group: ROTATION VALUES / circumference
pi_6 = Pi(Factor=2)

# ---- group: ROTATION VALUES
profile_curve_sides_4 = Panel(division)
expression_4 = Expression(x=pi_6, y=profile_curve_sides_4, z=series_4, Expression="(x/y)/(2^z)")
panel_7 = Panel(expression_4)
item_4 = ListItem(List=expression_4, Index=0, Wrap=True)  # -> Item, Item1, Item2, Item3

# ----
number_slider_12 = Slider(1, range=0..1)  # disabled
number_slider_13 = Slider(0, range=0..1)  # disabled
branch_rotation_3 = Slider(0.25, range=0..2)  # disabled
branch_count_3 = Slider(3, range=1..6)  # disabled
frame_count_3 = Slider(20, range=5..20)  # disabled
distance_3 = Slider(2374, range=0..3000)  # disabled
z_angle_3 = Slider(0.353, range=0..0.5)  # disabled
list_5 = ValueList({"Perpendicular Frame": 0, "Horizontal Frame": 1}, selected="Perpendicular Frame")  # disabled
cluster_9 = Cluster_5(
    profile_curves_from_branch_crv=cluster_4.profile_curves_crv,
    profile_curve_frames_from_branch_pl=cluster_4.frames_from_profile_curves_pl,
    branch_item_selection_0_1=0)  # -> selected_profile_curves, selected_profile_curve_frames, selected_path_tree_index; disabled
list_6 = ValueList({"Line": 0, "Curve": 1}, selected="Curve")  # disabled
cluster_10 = Cluster(
    type_of_curve=list_6,
    base_plane=cluster_9.selected_profile_curve_frames,
    branch_count=branch_count_3,
    branch_lenght=distance_3,
    branch_rotation=branch_rotation_3,
    z_axis_rotation=z_angle_3)  # -> branch_curves_crv, guide_vectors, base_plane_2; disabled
cluster_11 = Cluster_2(
    type_of_plane=list_5,
    branch_curves=cluster_10.branch_curves_crv,
    guide_vector_s=cluster_10.guide_vectors,
    plane_section_count=frame_count_3,
    branch_base_plane_pl=cluster_10.base_plane_2,
    rotation_transition_0_to_1=number_slider_12,
    rotation_transition_0_to_1_2=number_slider_13)  # disabled
cluster_12 = Cluster_3(
    branch_profile_curve_to_match_crv=cluster_9.selected_profile_curves,
    branch_count=branch_count_3,
    frames_from_profile_curves_to_match_pl=cluster_9.selected_profile_curve_frames,
    planes_to_match_profile_with=cluster_11,
    total_rotation_radians=item.Item1)  # -> profile_curves_crv, frames_from_profile_curves_pl; disabled

list_7 = ValueList({"From Last Branch Item": 0, "Select Branch Item": 1}, selected="Select Branch Item")  # disabled
number_slider_14 = Slider(1, range=0..1)  # disabled
number_slider_15 = Slider(0, range=0..1)  # disabled
branch_rotation_4 = Slider(0.25, range=0..2)  # disabled
branch_count_4 = Slider(1, range=1..6)  # disabled
frame_count_4 = Slider(20, range=5..20)  # disabled
distance_4 = Slider(2374, range=0..3000)  # disabled
z_angle_4 = Slider(0.353, range=0..0.5)  # disabled
list_8 = ValueList({"Perpendicular Frame": 0, "Horizontal Frame": 1}, selected="Perpendicular Frame")  # disabled
cluster_13 = Cluster_5(
    profile_curves_from_branch_crv=cluster_4.profile_curves_crv,
    profile_curve_frames_from_branch_pl=cluster_4.frames_from_profile_curves_pl,
    branch_item_selection_0_1=list_7,
    branch_path_int=Slider(13, range=0..20))  # -> selected_profile_curves, selected_profile_curve_frames, selected_path_tree_index; disabled
list_9 = ValueList({"Line": 0, "Curve": 1}, selected="Curve")  # disabled
cluster_14 = Cluster(
    type_of_curve=list_9,
    base_plane=cluster_13.selected_profile_curve_frames,
    branch_count=branch_count_4,
    branch_lenght=distance_4,
    branch_rotation=branch_rotation_4,
    z_axis_rotation=z_angle_4)  # -> branch_curves_crv, guide_vectors, base_plane_2; disabled
cluster_15 = Cluster_2(
    type_of_plane=list_8,
    branch_curves=cluster_14.branch_curves_crv,
    guide_vector_s=cluster_14.guide_vectors,
    plane_section_count=frame_count_4,
    branch_base_plane_pl=cluster_14.base_plane_2,
    rotation_transition_0_to_1=number_slider_14,
    rotation_transition_0_to_1_2=number_slider_15)  # disabled
cluster_16 = Cluster_3(
    branch_profile_curve_to_match_crv=cluster_13.selected_profile_curves,
    branch_count=branch_count_4,
    frames_from_profile_curves_to_match_pl=cluster_13.selected_profile_curve_frames,
    planes_to_match_profile_with=cluster_15,
    total_rotation_radians=item.Item1)  # -> profile_curves_crv, frames_from_profile_curves_pl; disabled

number_slider_16 = Slider(1, range=0..1)  # disabled
number_slider_17 = Slider(0, range=0..1)  # disabled
branch_rotation_5 = Slider(0, range=0..2)  # disabled
branch_count_5 = Slider(4, range=1..6)  # disabled
frame_count_5 = Slider(20, range=5..20)  # disabled
distance_5 = Slider(1260, range=0..3000)  # disabled
z_angle_5 = Slider(0.353, range=0..0.5)  # disabled
list_10 = ValueList({"Perpendicular Frame": 0, "Horizontal Frame": 1}, selected="Perpendicular Frame")  # disabled
cluster_17 = Cluster_5(
    profile_curves_from_branch_crv=cluster_8.profile_curves_crv,
    profile_curve_frames_from_branch_pl=cluster_8.frames_from_profile_curves_pl,
    branch_item_selection_0_1=0)  # -> selected_profile_curves, selected_profile_curve_frames, selected_path_tree_index; disabled
list_11 = ValueList({"Line": 0, "Curve": 1}, selected="Curve")  # disabled
cluster_18 = Cluster(
    type_of_curve=list_11,
    base_plane=cluster_17.selected_profile_curve_frames,
    branch_count=branch_count_5,
    branch_lenght=distance_5,
    branch_rotation=branch_rotation_5,
    z_axis_rotation=z_angle_5)  # -> branch_curves_crv, guide_vectors, base_plane_2; disabled
cluster_19 = Cluster_2(
    type_of_plane=list_10,
    branch_curves=cluster_18.branch_curves_crv,
    guide_vector_s=cluster_18.guide_vectors,
    plane_section_count=frame_count_5,
    branch_base_plane_pl=cluster_18.base_plane_2,
    rotation_transition_0_to_1=number_slider_16,
    rotation_transition_0_to_1_2=number_slider_17)  # disabled
cluster_20 = Cluster_3(
    branch_profile_curve_to_match_crv=cluster_17.selected_profile_curves,
    branch_count=branch_count_5,
    frames_from_profile_curves_to_match_pl=cluster_17.selected_profile_curve_frames,
    planes_to_match_profile_with=cluster_19,
    total_rotation_radians=item_3.Item1)  # -> profile_curves_crv, frames_from_profile_curves_pl; disabled

branch_rotation_6 = Slider(0, range=0..2)
branch_count_6 = Slider(1, range=1..6)
frame_count_6 = Slider(20, range=5..20)
distance_6 = Slider(5000, range=0..5000)
z_angle_6 = Slider(0.5, range=0..0.5)
list_12 = ValueList({"Perpendicular Frame": 0, "Horizontal Frame": 1}, selected="Perpendicular Frame")
branch_selector = Cluster_5(profile_curves_from_branch_crv=intcrv.Curve, profile_curve_frames_from_branch_pl=xy, branch_item_selection_0_1=0)  # -> selected_profile_curves, selected_profile_curve_frames, selected_path_tree_index
list_13 = ValueList({"Line": 0, "Curve": 1}, selected="Line")
branch_creator = Cluster(
    type_of_curve=list_13,
    base_plane=branch_selector.selected_profile_curve_frames,
    branch_count=branch_count_6,
    branch_lenght=distance_6,
    branch_rotation=branch_rotation_6,
    z_axis_rotation=z_angle_6)  # -> branch_curves_crv, guide_vectors, base_plane_2
frame_generator = Cluster_2(
    type_of_plane=list_12,
    branch_curves=branch_creator.branch_curves_crv,
    guide_vector_s=branch_creator.guide_vectors,
    plane_section_count=frame_count_6,
    branch_base_plane_pl=branch_creator.base_plane_2,
    rotation_transition_0_to_1=Slider(1, range=0..1),
    rotation_transition_0_to_1_2=Slider(0, range=0..1))
orientation_engine = Cluster_3(
    branch_profile_curve_to_match_crv=branch_selector.selected_profile_curves,
    branch_count=branch_count_6,
    frames_from_profile_curves_to_match_pl=branch_selector.selected_profile_curve_frames,
    planes_to_match_profile_with=frame_generator,
    total_rotation_radians=item_4.Item)  # -> profile_curves_crv, frames_from_profile_curves_pl
region_intersection_system = Cluster_6(profile_curves_from_branch_crv=orientation_engine.profile_curves_crv)
geometry_creator = Cluster_4(intersected_curves_crv=region_intersection_system, branch_frames_pl=frame_generator)  # -> sweep_surface, mesh_from_loft_m, mesh_from_sweep_curface_m

list_14 = ValueList({"Mesh Loft": 0, "Mesh from Sweep": 1}, selected="Mesh from Sweep")  # disabled

number_slider_18 = Slider(0, range=0..1)  # disabled
number_slider_19 = Slider(1, range=0..1)  # disabled
branch_rotation_7 = Slider(0, range=0..2)  # disabled
branch_count_7 = Slider(1, range=1..6)  # disabled
frame_count_7 = Slider(20, range=5..20)  # disabled
distance_7 = Slider(5000, range=0..5000)  # disabled
z_angle_7 = Slider(0.5, range=0..0.5)  # disabled
list_15 = ValueList({"Perpendicular Frame": 0, "Horizontal Frame": 1}, selected="Perpendicular Frame")  # disabled
cluster_21 = Cluster_5(profile_curves_from_branch_crv=polygon_2.Polygon, profile_curve_frames_from_branch_pl=xy_4, branch_item_selection_0_1=0)  # -> selected_profile_curves, selected_profile_curve_frames, selected_path_tree_index; disabled
list_16 = ValueList({"Line": 0, "Curve": 1}, selected="Line")  # disabled
cluster_22 = Cluster(
    type_of_curve=list_16,
    base_plane=cluster_21.selected_profile_curve_frames,
    branch_count=branch_count_7,
    branch_lenght=distance_7,
    branch_rotation=branch_rotation_7,
    z_axis_rotation=z_angle_7)  # -> branch_curves_crv, guide_vectors, base_plane_2; disabled
cluster_23 = Cluster_2(
    type_of_plane=list_15,
    branch_curves=cluster_22.branch_curves_crv,
    guide_vector_s=cluster_22.guide_vectors,
    plane_section_count=frame_count_7,
    branch_base_plane_pl=cluster_22.base_plane_2,
    rotation_transition_0_to_1=number_slider_19,
    rotation_transition_0_to_1_2=number_slider_18)  # disabled
cluster_24 = Cluster_3(
    branch_profile_curve_to_match_crv=cluster_21.selected_profile_curves,
    branch_count=branch_count_7,
    frames_from_profile_curves_to_match_pl=cluster_21.selected_profile_curve_frames,
    planes_to_match_profile_with=cluster_23,
    total_rotation_radians=item_2.Item)  # -> profile_curves_crv, frames_from_profile_curves_pl; disabled
cluster_25 = Cluster_6(profile_curves_from_branch_crv=cluster_24.profile_curves_crv)  # disabled
cluster_26 = Cluster_4(intersected_curves_crv=cluster_25, branch_frames_pl=cluster_23)  # -> sweep_surface, mesh_from_loft_m, mesh_from_sweep_curface_m; disabled
filter = StreamFilter(Gate=list_14, Stream0=cluster_26.mesh_from_loft_m, Stream1=cluster_26.mesh_from_sweep_curface_m)  # disabled

# ---- group: last distance divided by half
panel_8 = Panel("2")  # disabled
division_2 = Division(A=distance_7, B=panel_8)  # disabled

# ----
number_slider_20 = Slider(1, range=0..1)  # disabled
number_slider_21 = Slider(0, range=0..1)  # disabled
branch_rotation_8 = Slider(0, range=0..2)  # disabled
branch_count_8 = Slider(1, range=1..6)  # disabled
frame_count_8 = Slider(20, range=5..20)  # disabled
z_angle_8 = Slider(0.5, range=0..0.5)  # disabled
list_17 = ValueList({"Perpendicular Frame": 0, "Horizontal Frame": 1}, selected="Perpendicular Frame")  # disabled
cluster_27 = Cluster_5(
    profile_curves_from_branch_crv=cluster_24.profile_curves_crv,
    profile_curve_frames_from_branch_pl=cluster_24.frames_from_profile_curves_pl,
    branch_item_selection_0_1=0)  # -> selected_profile_curves, selected_profile_curve_frames, selected_path_tree_index; disabled
list_18 = ValueList({"Line": 0, "Curve": 1}, selected="Line")  # disabled
cluster_28 = Cluster(
    type_of_curve=list_18,
    base_plane=cluster_27.selected_profile_curve_frames,
    branch_count=branch_count_8,
    branch_lenght=division_2,
    branch_rotation=branch_rotation_8,
    z_axis_rotation=z_angle_8)  # -> branch_curves_crv, guide_vectors, base_plane_2; disabled
cluster_29 = Cluster_2(
    type_of_plane=list_17,
    branch_curves=cluster_28.branch_curves_crv,
    guide_vector_s=cluster_28.guide_vectors,
    plane_section_count=frame_count_8,
    branch_base_plane_pl=cluster_28.base_plane_2,
    rotation_transition_0_to_1=number_slider_20,
    rotation_transition_0_to_1_2=number_slider_21)  # disabled
cluster_30 = Cluster_3(
    branch_profile_curve_to_match_crv=cluster_27.selected_profile_curves,
    branch_count=branch_count_8,
    frames_from_profile_curves_to_match_pl=cluster_27.selected_profile_curve_frames,
    planes_to_match_profile_with=cluster_29,
    total_rotation_radians=item_2.Item1)  # -> profile_curves_crv, frames_from_profile_curves_pl; disabled
cluster_31 = Cluster_6(profile_curves_from_branch_crv=cluster_30.profile_curves_crv)  # disabled
cluster_32 = Cluster_4(intersected_curves_crv=cluster_31, branch_frames_pl=cluster_29)  # -> sweep_surface, mesh_from_loft_m, mesh_from_sweep_curface_m; disabled
filter_2 = StreamFilter(Gate=list_14, Stream0=cluster_32.mesh_from_loft_m, Stream1=cluster_32.mesh_from_sweep_curface_m)  # disabled

number_slider_22 = Slider(0, range=0..1)  # disabled
number_slider_23 = Slider(1, range=0..1)  # disabled
branch_rotation_9 = Slider(0.25, range=0..2)  # disabled
branch_count_9 = Slider(3, range=1..6)  # disabled
frame_count_9 = Slider(20, range=5..20)  # disabled
distance_8 = Slider(2374, range=0..3000)  # disabled
z_angle_9 = Slider(0.353, range=0..0.5)  # disabled
list_19 = ValueList({"Perpendicular Frame": 0, "Horizontal Frame": 1}, selected="Perpendicular Frame")  # disabled
cluster_33 = Cluster_5(
    profile_curves_from_branch_crv=cluster_12.profile_curves_crv,
    profile_curve_frames_from_branch_pl=cluster_12.frames_from_profile_curves_pl,
    branch_item_selection_0_1=0)  # -> selected_profile_curves, selected_profile_curve_frames, selected_path_tree_index; disabled
list_20 = ValueList({"Line": 0, "Curve": 1}, selected="Curve")  # disabled
cluster_34 = Cluster(
    type_of_curve=list_20,
    base_plane=cluster_33.selected_profile_curve_frames,
    branch_count=branch_count_9,
    branch_lenght=distance_8,
    branch_rotation=branch_rotation_9,
    z_axis_rotation=z_angle_9)  # -> branch_curves_crv, guide_vectors, base_plane_2; disabled
cluster_35 = Cluster_2(
    type_of_plane=list_19,
    branch_curves=cluster_34.branch_curves_crv,
    guide_vector_s=cluster_34.guide_vectors,
    plane_section_count=frame_count_9,
    branch_base_plane_pl=cluster_34.base_plane_2,
    rotation_transition_0_to_1=number_slider_23,
    rotation_transition_0_to_1_2=number_slider_22)  # disabled
cluster_36 = Cluster_3(
    branch_profile_curve_to_match_crv=cluster_33.selected_profile_curves,
    branch_count=branch_count_9,
    frames_from_profile_curves_to_match_pl=cluster_33.selected_profile_curve_frames,
    planes_to_match_profile_with=cluster_35,
    total_rotation_radians=item.Item2)  # -> profile_curves_crv, frames_from_profile_curves_pl; disabled

number_slider_24 = Slider(0, range=0..1)  # disabled
number_slider_25 = Slider(1, range=0..1)  # disabled
branch_rotation_10 = Slider(1.63, range=0..2)  # disabled
branch_count_10 = Slider(2, range=1..6)  # disabled
frame_count_10 = Slider(20, range=5..20)  # disabled
distance_9 = Slider(492, range=0..3000)  # disabled
z_angle_10 = Slider(0.193, range=0..0.5)  # disabled
list_21 = ValueList({"Perpendicular Frame": 0, "Horizontal Frame": 1}, selected="Perpendicular Frame")  # disabled
cluster_37 = Cluster_5(
    profile_curves_from_branch_crv=cluster_20.profile_curves_crv,
    profile_curve_frames_from_branch_pl=cluster_20.frames_from_profile_curves_pl,
    branch_item_selection_0_1=0)  # -> selected_profile_curves, selected_profile_curve_frames, selected_path_tree_index; disabled
list_22 = ValueList({"Line": 0, "Curve": 1}, selected="Curve")  # disabled
cluster_38 = Cluster(
    type_of_curve=list_22,
    base_plane=cluster_37.selected_profile_curve_frames,
    branch_count=branch_count_10,
    branch_lenght=distance_9,
    branch_rotation=branch_rotation_10,
    z_axis_rotation=z_angle_10)  # -> branch_curves_crv, guide_vectors, base_plane_2; disabled
cluster_39 = Cluster_2(
    type_of_plane=list_21,
    branch_curves=cluster_38.branch_curves_crv,
    guide_vector_s=cluster_38.guide_vectors,
    plane_section_count=frame_count_10,
    branch_base_plane_pl=cluster_38.base_plane_2,
    rotation_transition_0_to_1=number_slider_25,
    rotation_transition_0_to_1_2=number_slider_24)  # disabled
cluster_40 = Cluster_3(
    branch_profile_curve_to_match_crv=cluster_37.selected_profile_curves,
    branch_count=branch_count_10,
    frames_from_profile_curves_to_match_pl=cluster_37.selected_profile_curve_frames,
    planes_to_match_profile_with=cluster_39,
    total_rotation_radians=item_3.Item2)  # -> profile_curves_crv, frames_from_profile_curves_pl; disabled

list_23 = ValueList({"Mesh Loft": 0, "Mesh from Sweep": 1}, selected="Mesh from Sweep")
filter_3 = StreamFilter(Gate=list_23, Stream0=geometry_creator.mesh_from_loft_m, Stream1=geometry_creator.mesh_from_sweep_curface_m)

# ---- group: last distance divided by half
panel_9 = Panel("2")  # disabled
division_3 = Division(A=division_2, B=panel_9)  # disabled

# ----
number_slider_26 = Slider(1, range=0..1)  # disabled
number_slider_27 = Slider(0, range=0..1)  # disabled
branch_rotation_11 = Slider(0, range=0..2)  # disabled
branch_count_11 = Slider(1, range=1..6)  # disabled
frame_count_11 = Slider(20, range=5..20)  # disabled
z_angle_11 = Slider(0.5, range=0..0.5)  # disabled
list_24 = ValueList({"Perpendicular Frame": 0, "Horizontal Frame": 1}, selected="Perpendicular Frame")  # disabled
cluster_41 = Cluster_5(
    profile_curves_from_branch_crv=cluster_30.profile_curves_crv,
    profile_curve_frames_from_branch_pl=cluster_30.frames_from_profile_curves_pl,
    branch_item_selection_0_1=0)  # -> selected_profile_curves, selected_profile_curve_frames, selected_path_tree_index; disabled
list_25 = ValueList({"Line": 0, "Curve": 1}, selected="Line")  # disabled
cluster_42 = Cluster(
    type_of_curve=list_25,
    base_plane=cluster_41.selected_profile_curve_frames,
    branch_count=branch_count_11,
    branch_lenght=division_3,
    branch_rotation=branch_rotation_11,
    z_axis_rotation=z_angle_11)  # -> branch_curves_crv, guide_vectors, base_plane_2; disabled
cluster_43 = Cluster_2(
    type_of_plane=list_24,
    branch_curves=cluster_42.branch_curves_crv,
    guide_vector_s=cluster_42.guide_vectors,
    plane_section_count=frame_count_11,
    branch_base_plane_pl=cluster_42.base_plane_2,
    rotation_transition_0_to_1=number_slider_26,
    rotation_transition_0_to_1_2=number_slider_27)  # disabled
cluster_44 = Cluster_3(
    branch_profile_curve_to_match_crv=cluster_41.selected_profile_curves,
    branch_count=branch_count_11,
    frames_from_profile_curves_to_match_pl=cluster_41.selected_profile_curve_frames,
    planes_to_match_profile_with=cluster_43,
    total_rotation_radians=item_2.Item2)  # -> profile_curves_crv, frames_from_profile_curves_pl; disabled
cluster_45 = Cluster_6(profile_curves_from_branch_crv=cluster_44.profile_curves_crv)  # disabled
cluster_46 = Cluster_4(intersected_curves_crv=cluster_45, branch_frames_pl=cluster_43)  # -> sweep_surface, mesh_from_loft_m, mesh_from_sweep_curface_m; disabled
filter_4 = StreamFilter(Gate=list_14, Stream0=cluster_46.mesh_from_loft_m, Stream1=cluster_46.mesh_from_sweep_curface_m)  # disabled

material = CreateMaterial(
    Diffuse=ColourSwatch(SwatchColor=RGB(255, 255, 255)),
    Specular=RGB(255, 255, 255),
    Emission=RGB(0, 0, 0),
    Transparency=0,
    Shine=Slider(24, range=0..100))
preview = CustomPreview(Geometry=filter_3, Shader=material)
list_26 = ValueList({"Mesh from Sweep": 0, "Mesh Loft": 1}, selected="Mesh Loft")  # disabled
list_27 = ValueList({"Mesh from Sweep": 0, "Mesh Loft": 1}, selected="Mesh Loft")  # disabled
cluster_47 = Cluster_6(profile_curves_from_branch_crv=cluster_16.profile_curves_crv)  # disabled
cluster_48 = Cluster_6(profile_curves_from_branch_crv=cluster_4.profile_curves_crv)  # disabled
cluster_49 = Cluster_6(profile_curves_from_branch_crv=cluster_12.profile_curves_crv)  # disabled
cluster_50 = Cluster_6(profile_curves_from_branch_crv=cluster_36.profile_curves_crv)  # disabled
cluster_51 = Cluster_6(profile_curves_from_branch_crv=cluster_40.profile_curves_crv)  # disabled
cluster_52 = Cluster_6(profile_curves_from_branch_crv=cluster_20.profile_curves_crv)  # disabled
cluster_53 = Cluster_6(profile_curves_from_branch_crv=cluster_8.profile_curves_crv)  # disabled
cluster_54 = Cluster_4(intersected_curves_crv=cluster_47, branch_frames_pl=cluster_15)  # -> sweep_surface, mesh_from_loft_m, mesh_from_sweep_curface_m; disabled
cluster_55 = Cluster_4(intersected_curves_crv=cluster_48, branch_frames_pl=cluster_3)  # -> sweep_surface, mesh_from_loft_m, mesh_from_sweep_curface_m; disabled
cluster_56 = Cluster_4(intersected_curves_crv=cluster_49, branch_frames_pl=cluster_11)  # -> sweep_surface, mesh_from_loft_m, mesh_from_sweep_curface_m; disabled
cluster_57 = Cluster_4(intersected_curves_crv=cluster_50, branch_frames_pl=cluster_35)  # -> sweep_surface, mesh_from_loft_m, mesh_from_sweep_curface_m; disabled
cluster_58 = Cluster_4(intersected_curves_crv=cluster_51, branch_frames_pl=cluster_39)  # -> sweep_surface, mesh_from_loft_m, mesh_from_sweep_curface_m; disabled
cluster_59 = Cluster_4(intersected_curves_crv=cluster_52, branch_frames_pl=cluster_19)  # -> sweep_surface, mesh_from_loft_m, mesh_from_sweep_curface_m; disabled
cluster_60 = Cluster_4(intersected_curves_crv=cluster_53, branch_frames_pl=cluster_7)  # -> sweep_surface, mesh_from_loft_m, mesh_from_sweep_curface_m; disabled
filter_5 = StreamFilter(Gate=list_27, Stream0=cluster_58.mesh_from_loft_m, Stream1=cluster_58.mesh_from_sweep_curface_m)  # disabled
filter_6 = StreamFilter(Gate=list_26, Stream0=cluster_54.mesh_from_loft_m, Stream1=cluster_54.mesh_from_sweep_curface_m)  # disabled
filter_7 = StreamFilter(Gate=list_26, Stream0=cluster_55.mesh_from_loft_m, Stream1=cluster_55.mesh_from_sweep_curface_m)  # disabled
filter_8 = StreamFilter(Gate=list_26, Stream0=cluster_56.mesh_from_loft_m, Stream1=cluster_56.mesh_from_sweep_curface_m)  # disabled
filter_9 = StreamFilter(Gate=list_26, Stream0=cluster_57.mesh_from_loft_m, Stream1=cluster_57.mesh_from_sweep_curface_m)  # disabled
filter_10 = StreamFilter(Gate=list_27, Stream0=cluster_59.mesh_from_loft_m, Stream1=cluster_59.mesh_from_sweep_curface_m)  # disabled
filter_11 = StreamFilter(Gate=list_27, Stream0=cluster_60.mesh_from_loft_m, Stream1=cluster_60.mesh_from_sweep_curface_m)  # disabled
number_slider_28 = Slider(24, range=0..100)  # disabled
swatch = ColourSwatch(SwatchColor=RGB(255, 252, 99))  # disabled
material_2 = CreateMaterial(Diffuse=swatch, Specular=RGB(255, 255, 255), Emission=RGB(0, 0, 0), Transparency=0, Shine=number_slider_28)  # disabled
number_slider_29 = Slider(24, range=0..100)  # disabled
swatch_2 = ColourSwatch(SwatchColor=RGB(230, 73, 73))  # disabled
preview_2 = CustomPreview(Geometry=[filter_11, filter_10, filter_5], Shader=material_2)  # disabled
number_slider_30 = Slider(24, range=0..100)  # disabled
swatch_3 = ColourSwatch(SwatchColor=RGB(20, 118, 255))  # disabled
material_3 = CreateMaterial(Diffuse=swatch_2, Specular=RGB(255, 255, 255), Emission=RGB(0, 0, 0), Transparency=0, Shine=number_slider_29)  # disabled
preview_3 = CustomPreview(Geometry=[filter_7, filter_8, filter_9, filter_6], Shader=material_3)  # disabled
material_4 = CreateMaterial(Diffuse=swatch_3, Specular=RGB(255, 255, 255), Emission=RGB(0, 0, 0), Transparency=0, Shine=number_slider_30)  # disabled
preview_4 = CustomPreview(Geometry=[filter, filter_2, filter_4], Shader=material_4)  # disabled

# ==== cluster Cluster
type_of_curve = ClusterInput()  # 0 for line, 1 for curve
branch_count = ClusterInput()
branch_lenght = ClusterInput()  # Linear lenght
branch_rotation = ClusterInput()  # plane rotation for branches
z_axis_rotation = ClusterInput()  # Branch inclination
base_plane = ClusterInput()  # Insert plane to branch off

# ---- group: Branch Curves
num = Number(branch_rotation)
G = Gate(type_of_curve)
pln = Plane(base_plane)
num_2 = Number(z_axis_rotation)
num_3 = Number(branch_lenght)
num_4 = Number(branch_count)
pi = Pi(Factor="2")
range = Range(Domain=pi, Steps=num_4)
pi_2 = Pi(Factor=num)
item = ListItem(List=pln, Index=0, Wrap=True)
shift = ShiftList(List=range, Shift="-1", Wrap=invert(True))
prot = RotatePlane(Plane=item, Angle=pi_2)
pi_3 = Pi(Factor=num_2)
pt = PointPolar(BasePlane=prot, XYAngle=shift, ZAngle=pi_3, Offset=num_3)
vec2pt = Vector2Pt(PointA=prot, PointB=pt, Unitize=False)  # -> Vector, Length
line = LineSDL(Start=prot, Direction=vec2pt.Vector, Length=vec2pt.Length)
end = EndPoints(Curve=line)  # -> Start, End
arc = ArcSED(Start=end.Start, End=end.End, Direction=prot)  # -> Arc, Plane, Radius
filter = StreamFilter(Gate=G, Stream0=line, Stream1=arc.Arc)
pln_2 = Plane(prot)
vec = Vector(vec2pt.Vector)

# ----
base_plane_2 = ClusterOutput(pln_2)  # Branch base plane
guide_vectors = ClusterOutput(vec)  # branch curve direction
branch_curves_crv = ClusterOutput(filter)  # branched curves

# ==== cluster Cluster_2
type_of_plane = ClusterInput()  # 0 for perdendicular frames, 1 for horizontal frames
branch_curves = ClusterInput()  # Insert cuves for section planes
guide_vector_s = ClusterInput()  # Curve guide Vectors
plane_section_count = ClusterInput()  # Curve plane section count
branch_base_plane_pl = ClusterInput()  # Branch base plane
rotation_transition_0_to_1 = ClusterInput()  # First rotation transition. From 0 to 1
rotation_transition_0_to_1_2 = ClusterInput()  # Second rotation transition. From 0 to 1

# ---- group: Branch Frames
G = Gate(type_of_plane)
crv = Curve(branch_curves)
pln = Plane(branch_base_plane_pl)
num = Number(rotation_transition_0_to_1)
num_2 = Number(rotation_transition_0_to_1_2)
num_3 = Number(plane_section_count)
vec = Vector(guide_vector_s)
expression = Expression(x=num_3, Expression="x-1")
project = Project(Geometry=vec, Plane=pln)  # -> Geometry, Transform
cp = ControlPoints(Curve=crv)  # -> Points, Weights, Knots
pframes = PerpFrames(Curve=crv, Count=expression, Align=True)  # -> simplify(Frames), Parameters
lng = ListLength(List=cp.Points)
hframes = HorizontalFrames(Curve=crv, Count=expression)  # -> Frames, Parameters
lng_2 = ListLength(List=crv)
expression_2 = Expression(x=lng, Expression="if(x=2,0,1)")
dup = DuplicateData(Data=pln, Number=lng_2, Order=True)
align = AlignPlane(Plane=pframes.Frames, Direction=graft(project.Geometry))  # -> simplify(Plane), Angle
align_2 = AlignPlane(Plane=hframes.Frames, Direction=vec)  # -> simplify(Plane), Angle
graft = GraftTree(Tree=dup, IncludeEmptyLists=True, IncludeNullItems=True)
lng_3 = ListLength(List=align.Plane)
dup_2 = DuplicateData(Data=expression_2, Number=lng_3, Order=True)
p_n_c = PickNChoose(Pattern=dup_2, Stream0=align_2.Plane, Stream1=hframes.Frames)
p_n_c_2 = PickNChoose(Pattern=dup_2, Stream0=align.Plane, Stream1=pframes.Frames)
filter = StreamFilter(Gate=G, Stream0=p_n_c_2, Stream1=p_n_c)
dom = ConstructDomain(DomainStart=num, DomainEnd=num_2)
range = Range(Domain=dom, Steps=expression)
deplane = DeconstructPlane(Plane=filter)  # -> Origin, XAxis, YAxis, ZAxis
angle = Angle(VectorA=filter, VectorB=graft)  # -> Angle, Reflex
line = LineSDL(Start=deplane.Origin, Direction=deplane.YAxis, Length=1000)
multiplication = Multiplication(A=angle.Angle, B=range)
neg = Negative(Value=multiplication)
rotax = RotateAxis(Geometry=filter, Angle=neg, Axis=line)  # -> simplify(Geometry), Transform

# ----
branch_frames_pl = ClusterOutput(rotax.Geometry)  # Branch Frames from Curves

# ==== cluster Cluster_3
branch_count = ClusterInput()  # Branch Count
branch_profile_curve_to_match_crv = ClusterInput()  # Profile Curve to Match
frames_from_profile_curves_to_match_pl = ClusterInput()  # Frames from Profile Curves to Match
planes_to_match_profile_with = ClusterInput()  # Planes to match Profile with
total_rotation_radians = ClusterInput()
data_to_match = Data(branch_profile_curve_to_match_crv)
planes_to_match_with = Tree(planes_to_match_profile_with)
branch_count_2 = Number(branch_count)

# ---- group: Curve Profile DM
data_to_match_2 = Data(data_to_match)
branch_count_3 = Number(branch_count_2)
planes_to_match_with_2 = Tree(planes_to_match_with)
group = Group(Objects=data_to_match_2)
dup = DuplicateData(Data=simplify(group), Number=branch_count_3, Order=True)
tstat = TreeStatistics(Tree=planes_to_match_with_2)  # -> Paths, Length, Count
graft = GraftTree(Tree=dup, IncludeEmptyLists=True, IncludeNullItems=True)
graft_2 = GraftTree(Tree=tstat.Length, IncludeEmptyLists=True, IncludeNullItems=True)
dup_2 = DuplicateData(Data=graft, Number=graft_2, Order=True)
graft_3 = GraftTree(Tree=dup_2, IncludeEmptyLists=True, IncludeNullItems=True)
ungroup = Ungroup(Group=graft_3)  # -> simplify(Objects)

# ---- group: Frames DM
data_to_match_3 = Data(frames_from_profile_curves_to_match_pl)
planes_to_match_with_3 = Tree(planes_to_match_with)
branch_count_4 = Number(branch_count_2)
group_2 = Group(Objects=data_to_match_3)
dup_3 = DuplicateData(Data=simplify(group_2), Number=branch_count_4, Order=True)
tstat_2 = TreeStatistics(Tree=planes_to_match_with_3)  # -> Paths, Length, Count
graft_4 = GraftTree(Tree=dup_3, IncludeEmptyLists=True, IncludeNullItems=True)
graft_5 = GraftTree(Tree=tstat_2.Length, IncludeEmptyLists=True, IncludeNullItems=True)
dup_4 = DuplicateData(Data=graft_4, Number=graft_5, Order=True)
graft_6 = GraftTree(Tree=dup_4, IncludeEmptyLists=True, IncludeNullItems=True)
ungroup_2 = Ungroup(Group=graft_6)  # -> simplify(Objects)

# ---- group: Rotation Values DM
profile_curves_to_match_with = Data(data_to_match)
plane_to_match_with = Tree(planes_to_match_with)
rotation_value = Number(total_rotation_radians)
tstat_3 = TreeStatistics(Tree=plane_to_match_with)  # -> Paths, Length, Count
tstat_4 = TreeStatistics(Tree=profile_curves_to_match_with)  # -> Paths, Length, Count
item = ListItem(List=tstat_4.Length, Index=0, Wrap=True)

# ----
expression = Expression(x=tstat_3.Length, Expression="x-1")
range = Range(Domain=rotation_value, Steps=expression)
graft_7 = GraftTree(Tree=range, IncludeEmptyLists=True, IncludeNullItems=True)

# ---- group: Rotation Values DM (continued)
dup_5 = DuplicateData(Data=graft_7, Number=item, Order=True)
neg = Negative(Value=dup_5)
weave = Weave(Pattern=[0, 1], Stream0=dup_5, Stream1=neg, NullGaps=False)  # -> simplify(Weave)

# ---- group: Profile Curve Placement
frames_from_profile_curves = Plane(ungroup_2)
profile_curves = Curve(ungroup)
rotation_values = Number(weave)
branch_frames = Plane(planes_to_match_with)
graft_8 = GraftTree(Tree=branch_frames, IncludeEmptyLists=True, IncludeNullItems=True)
pl_origin = PlaneOrigin(Base=frames_from_profile_curves, Origin=graft_8)

# ----
graft_9 = GraftTree(Tree=pl_origin, IncludeEmptyLists=True, IncludeNullItems=True)
partition = PartitionList(List=rotation_values, Size=2)

# ---- group: Profile Curve Placement (continued)
prot = RotatePlane(Plane=graft_9, Angle=partition)

# ----
shift = ShiftPaths(Data=prot, Offset=-1)

# ---- group: Profile Curve Placement (continued)
padjust = AdjustPlane(Plane=shift, Normal=graft_8)
orient = Orient(Geometry=profile_curves, Source=frames_from_profile_curves, Target=padjust)  # -> Geometry, Transform

# ----
profile_curves_crv = ClusterOutput(orient.Geometry)
frames_from_profile_curves_pl = ClusterOutput(padjust)  # Frames from Profile Curves

# ==== cluster Cluster_4
intersected_curves_crv = ClusterInput()  # Intersected Profile Cruves to create Geometry
branch_frames_pl = ClusterInput()  # Branch frames from curves

# ---- group: Sweep Column
branch_frames = Plane(branch_frames_pl)
intersected_curves = Curve(intersected_curves_crv)
graft = GraftTree(Tree=branch_frames, IncludeEmptyLists=True, IncludeNullItems=True)
deplane = DeconstructPlane(Plane=graft)  # -> Origin, XAxis, YAxis, ZAxis
line = LineSDL(Start=deplane.Origin, Direction=deplane.XAxis, Length="1000")
ccx = CurveCurve(CurveA=intersected_curves, CurveB=line)  # -> Points, ParamsA, ParamsB
seam = Seam(Curve=intersected_curves, Seam=ccx.ParamsA)  # -> simplify(Curve)
shift = ShiftPaths(Data=seam, Offset=-1)

# ----
tstat = TreeStatistics(Tree=shift)  # -> Paths, Length, Count
item = ListItem(List=tstat.Paths, Index=0, Wrap=True)
concat = Concatenate(FragmentA=item, FragmentB="(+1)")

# ---- group: Sweep Column (continued)
relitem = RelativeItem(Tree=simplify(shift), Offset=concat, WrapPaths=False, WrapItems=False)  # -> ItemA, ItemB
end = EndPoints(Curve=relitem.ItemA)  # -> Start, End
end_2 = EndPoints(Curve=relitem.ItemB)  # -> Start, End
ln = Line(StartPoint=end.Start, EndPoint=end_2.Start)
swp2 = Sweep2(
    Rail1=reparameterize(graft(relitem.ItemA)),
    Rail2=reparameterize(graft(relitem.ItemB)),
    Sections=reparameterize(graft(ln)),
    SameHeight=False)  # -> simplify(Brep)
shift_2 = ShiftPaths(Data=swp2, Offset=-1)

# ---- group: Mesh loft visualization
crv = Curve(shift)
mloft = MeshLoft(Curves=crv, Segments=300)
wbjoin = WeaverbirdsJoinMeshesAndWeld(Mesh=mloft, Weld=invert(False))

# ---- group: column visualization
brep = Brep(shift_2)
mesh = MeshBrep(
    Brep=brep,
    Settings={GridMaxCount=0, GridMinCount=16, JaggedSeams=False, MaxEdgeLength=0, MinEdgeLength=0.0001, MinTolerance=0, Refine=True, RefineAngle=0, RelativeTolerance=0.65, SimplePlanes=True, Tolerance=0})  # -> simplify(Mesh)
mjoin = MeshJoin(Meshes=mesh)

# ----
mesh_from_loft_m = ClusterOutput(wbjoin)  # Mesh loft from intersected curves
mesh_from_sweep_curface_m = ClusterOutput(mjoin)  # Mesh from intersected curves
sweep_surface = ClusterOutput(shift_2)  # Sweep surface from Instersected Curves

# ==== cluster Cluster_5
profile_curves_from_branch_crv = ClusterInput()  # Profile curves section to choose from
branch_path_int = ClusterInput()  # Connect integers numbers to create branch path
branch_item_selection_0_1 = ClusterInput()  # 0 to use last branch item, 1 to select branch item
profile_curve_frames_from_branch_pl = ClusterInput()  # Profile Curve Frames from Branch to choose from

# ---- group: branch sorting
int = Integer(branch_item_selection_0_1)
crv = Curve(simplify(profile_curves_from_branch_crv))
pln = Plane(simplify(profile_curve_frames_from_branch_pl))
int_2 = Integer(branch_path_int)
tstat = TreeStatistics(Tree=crv)  # -> Paths, Length, Count
item = ListItem(List=reverse(tstat.Paths), Index=0, Wrap=True)
dpath = DeconstructPath(Branch=item)
sort = SortList(Keys=dpath)  # -> reverse(Keys), ValuesA
item_2 = ListItem(List=sort.Keys, Index=0, Wrap=True)
path_mask = Panel("{*;x;*}")
to_replace = Panel("x")
int_3 = Integer(item_2)
rep = ReplaceText(Text=path_mask, Find=to_replace, Replace=int_3, RecursiveReplace=False)
path = ConstructPath(Indices=int_2)

# ----
filter = StreamFilter(Gate=int, Stream0=rep, Stream1=path)

# ---- group: branch sorting (continued)
split = SplitTree(Data=crv, Masks=flatten(filter))  # -> Positive, Negative
split_2 = SplitTree(Data=pln, Masks=flatten(filter))  # -> Positive, Negative

# ----
selected_profile_curves = ClusterOutput(split.Positive)  # Selected Profile Curves
selected_profile_curve_frames = ClusterOutput(split_2.Positive)  # Selected Profile Curve Frames
selected_path_tree_index = ClusterOutput(filter)  # Selected Path (Tree Index)

# ==== cluster Cluster_6
profile_curves_from_branch_crv = ClusterInput()  # Profile curves section to choose from

# ---- group: Curve intersection recurtion
crv = Curve(profile_curves_from_branch_crv)
lng = ListLength(List=crv)
logn = LogN(Number=lng, Base=2)  # -> expr("x-1", Result)
item = ListItem(List=flatten(logn), Index=0, Wrap=True)
fastloopstart = FastLoopStart(Iterations=item, Data=crv)  # -> port, Counter, Data
partition = PartitionList(List=fastloopstart.Data, Size="2")
item_2 = ListItem(List=partition, Index=0, Wrap=True)  # -> Item, Item1
rint = RegionIntersection(CurvesA=item_2.Item, CurvesB=item_2.Item1)  # -> simplify(Result)
shift = ShiftPaths(Data=rint, Offset=-1)
fastloopend = FastLoopEnd(port=fastloopstart.port, Exit=False, Data=shift, RecordData=False, TimeOutVal=0)  # -> graft(Data)

# ----
intersected_curves_crv = ClusterOutput(fastloopend)
