# Grasshopper definition Digital Column 4.0.gh (Grasshopper 0.9.76)
# plug-ins: MeshEdit Components, Python Interpreter, treesloth01, Human UI, Human, Weaverbird

# ---- group: ADD CURVE HERE
xy = XYPlane(Origin=Point(0, 0, 0))
crv = Curve(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)

# ---- group: ROTATION VALUES / levels
series = Series(Start="2", Step=1, Count=Slider(4, range=1..5))

# ---- group: ROTATION VALUES / circumference
pi = Pi(Factor=2)

# ---- group: ROTATION VALUES
profile_curve_sides = Panel("4")
expression = Expression(x=pi, y=profile_curve_sides, z=series, Expression="(x/y)/(2^z)")
panel = Panel(expression)
item = ListItem(List=expression, Index=0, Wrap=True)  # -> Item, Item1, Item2, Item3

# ----
branch_rotation = Slider(0, range=0..2)
branch_count = Slider(2, range=1..6)
frame_count = Slider(30, range=5..30)
distance = Slider(3000, range=0..3000)
z_angle = Slider(0.41, range=0..0.5)
list = ValueList({"Perpendicular Frame": 0, "Horizontal Frame": 1}, selected="Perpendicular Frame")
cluster = Cluster_4(profile_curves_from_branch_crv=crv, profile_curve_frames_from_branch_pl=xy, branch_item_selection_0_1=0)  # -> selected_profile_curves, selected_profile_curve_frames, selected_path_tree_index
list_2 = ValueList({"Line": 0, "Curve": 1}, selected="Curve")
cluster_2 = Cluster(
    type_of_curve=list_2,
    base_plane=cluster.selected_profile_curve_frames,
    branch_count=branch_count,
    branch_lenght=distance,
    branch_rotation=branch_rotation,
    z_axis_rotation=z_angle)  # -> branch_curves_crv, guide_vectors, base_plane_2
cluster_3 = Cluster_2(
    type_of_plane=list,
    branch_curves=cluster_2.branch_curves_crv,
    guide_vector_s=cluster_2.guide_vectors,
    plane_section_count=frame_count,
    branch_base_plane_pl=cluster_2.base_plane_2,
    rotation_transition_0_to_1=Slider(1, range=0..1),
    rotation_transition_0_to_1_2=Slider(0, range=0..1))
cluster_4 = Cluster_3(
    branch_profile_curve_to_match_crv=cluster.selected_profile_curves,
    branch_count=branch_count,
    frames_from_profile_curves_to_match_pl=cluster.selected_profile_curve_frames,
    planes_to_match_profile_with=cluster_3,
    total_rotation_radians=item.Item)  # -> profile_curves_crv, frames_from_profile_curves_pl

branch_rotation_2 = Slider(0, range=0..2)
branch_count_2 = Slider(4, range=1..6)
frame_count_2 = Slider(20, range=5..20)
distance_2 = Slider(1500, range=0..3000)
z_angle_2 = Slider(0.375, range=0..0.5)
list_3 = ValueList({"Perpendicular Frame": 0, "Horizontal Frame": 1}, selected="Perpendicular Frame")
cluster_5 = Cluster_4(
    profile_curves_from_branch_crv=cluster_4.profile_curves_crv,
    profile_curve_frames_from_branch_pl=cluster_4.frames_from_profile_curves_pl,
    branch_item_selection_0_1=0)  # -> selected_profile_curves, selected_profile_curve_frames, selected_path_tree_index
list_4 = ValueList({"Line": 0, "Curve": 1}, selected="Curve")
cluster_6 = Cluster(
    type_of_curve=list_4,
    base_plane=cluster_5.selected_profile_curve_frames,
    branch_count=branch_count_2,
    branch_lenght=distance_2,
    branch_rotation=branch_rotation_2,
    z_axis_rotation=z_angle_2)  # -> branch_curves_crv, guide_vectors, base_plane_2
cluster_7 = Cluster_2(
    type_of_plane=list_3,
    branch_curves=cluster_6.branch_curves_crv,
    guide_vector_s=cluster_6.guide_vectors,
    plane_section_count=frame_count_2,
    branch_base_plane_pl=cluster_6.base_plane_2,
    rotation_transition_0_to_1=Slider(1, range=0..1),
    rotation_transition_0_to_1_2=Slider(0, range=0..1))
cluster_8 = Cluster_3(
    branch_profile_curve_to_match_crv=cluster_5.selected_profile_curves,
    branch_count=branch_count_2,
    frames_from_profile_curves_to_match_pl=cluster_5.selected_profile_curve_frames,
    planes_to_match_profile_with=cluster_7,
    total_rotation_radians=item.Item1)  # -> profile_curves_crv, frames_from_profile_curves_pl

branch_rotation_3 = Slider(0, range=0..2)
branch_count_3 = Slider(1, range=1..6)
frame_count_3 = Slider(10, range=5..20)
distance_3 = Slider(492, range=0..3000)
z_angle_3 = Slider(0.495, range=0..0.5)
list_5 = ValueList({"Perpendicular Frame": 0, "Horizontal Frame": 1}, selected="Perpendicular Frame")
cluster_9 = Cluster_4(
    profile_curves_from_branch_crv=cluster_8.profile_curves_crv,
    profile_curve_frames_from_branch_pl=cluster_8.frames_from_profile_curves_pl,
    branch_item_selection_0_1=0)  # -> selected_profile_curves, selected_profile_curve_frames, selected_path_tree_index
list_6 = ValueList({"Line": 0, "Curve": 1}, selected="Line")
cluster_10 = Cluster(
    type_of_curve=list_6,
    base_plane=cluster_9.selected_profile_curve_frames,
    branch_count=branch_count_3,
    branch_lenght=distance_3,
    branch_rotation=branch_rotation_3,
    z_axis_rotation=z_angle_3)  # -> branch_curves_crv, guide_vectors, base_plane_2
cluster_11 = Cluster_2(
    type_of_plane=list_5,
    branch_curves=cluster_10.branch_curves_crv,
    guide_vector_s=cluster_10.guide_vectors,
    plane_section_count=frame_count_3,
    branch_base_plane_pl=cluster_10.base_plane_2,
    rotation_transition_0_to_1=Slider(1, range=0..1),
    rotation_transition_0_to_1_2=Slider(0, range=0..1))
cluster_12 = Cluster_3(
    branch_profile_curve_to_match_crv=cluster_9.selected_profile_curves,
    branch_count=branch_count_3,
    frames_from_profile_curves_to_match_pl=cluster_9.selected_profile_curve_frames,
    planes_to_match_profile_with=cluster_11,
    total_rotation_radians=item.Item2)  # -> profile_curves_crv, frames_from_profile_curves_pl

list_7 = ValueList({"Brep Sweep": 0, "Mesh Sweep": 1, "Mesh Loft": 2}, selected="Mesh Loft")
cluster_13 = Cluster_5(profile_curves_from_branch_crv=cluster_4.profile_curves_crv)
cluster_14 = Cluster_5(profile_curves_from_branch_crv=cluster_8.profile_curves_crv)
pshift = ShiftPaths(Data=cluster_14, Offset=-1)
cluster_15 = Cluster_5(profile_curves_from_branch_crv=cluster_12.profile_curves_crv)
pshift_2 = ShiftPaths(Data=cluster_15, Offset=-1)
item_2 = ListItem(List=reverse(pshift), Index=0, Wrap=True)
item_3 = ListItem(List=reverse(pshift_2), Index=0, Wrap=True)
pshift_3 = ShiftPaths(Data=cluster_13, Offset=-1)
cluster_16 = Visualization(intersected_curves_crv=cluster_15, branch_frames_pl=cluster_11, refinement=Slider(20, range=1..20))  # -> sweep_surface, mesh_from_sweep_curface_m, mesh_from_loft_m
cluster_17 = Visualization(intersected_curves_crv=cluster_14, branch_frames_pl=cluster_7, refinement=Slider(10, range=1..10))  # -> sweep_surface, mesh_from_sweep_curface_m, mesh_from_loft_m
cluster_18 = Visualization(intersected_curves_crv=cluster_13, branch_frames_pl=cluster_3, refinement=2)  # -> sweep_surface, mesh_from_sweep_curface_m, mesh_from_loft_m
item_4 = ListItem(List=reverse(pshift_3), Index=0, Wrap=True)
filter = StreamFilter(
    Gate=list_7,
    Stream0=cluster_16.sweep_surface,
    Stream1=cluster_16.mesh_from_sweep_curface_m,
    Stream2=cluster_16.mesh_from_loft_m)
filter_2 = StreamFilter(
    Gate=list_7,
    Stream0=cluster_18.sweep_surface,
    Stream1=cluster_18.mesh_from_sweep_curface_m,
    Stream2=cluster_18.mesh_from_loft_m)
filter_3 = StreamFilter(
    Gate=list_7,
    Stream0=cluster_17.sweep_surface,
    Stream1=cluster_17.mesh_from_sweep_curface_m,
    Stream2=cluster_17.mesh_from_loft_m)
mesh = Mesh(simplify(graft([filter_2, filter_3, filter])))
renumber = RenumberPaths(Data=mesh)
crvtoscreen = RenderCurveToScreen(ScaleFactor=1, Thickness=1, Depth=0.95, Fixed=True, m_scWithvp=False)
mjoin = MeshJoin(Meshes=flatten(renumber))
m_caps = MeshCaps(M=renumber, W=Toggle(False), O=Toggle(False), D=0)  # -> out, simplify(A), E; inputs M: Mesh, clr: Color
# ---------- m_caps: VB ----------
    Component.Params.Input(0).Name = "Mesh"
    Component.Params.Input(0).Description = "An open mesh"
    Component.Params.Input(1).Name = "Join and Weld"
    Component.Params.Input(1).Description = "If true the original mesh will be joined and welded to the new caps, else the caps will be output as a list of new meshes"
    Component.Params.Input(2).Name = "Simplify Faces"
    Component.Params.Input(2).Description = "If true, naked edges consisting of 3 to 4 segments will be replaced with a single face, else faces will use new center vertex method"
    Component.Params.Input(3).Name = "Distance (Optional, Rhino Units)"
    Component.Params.Input(3).Description = "A single number which sets the Rhino unit based distance that the center point will be offset from the vertex averages"

    Component.Params.Output(1).Name = "Mesh"
    Component.Params.Output(1).Description = "If successful, a list or single of valid meshes"
    Component.Params.Output(2).Name = "Polylines"
    Component.Params.Output(2).Description = "If successful, a list of valid edge polylines"

    If M IsNot Nothing Then
      Dim i,j,k,kk,ka As Integer
      Dim arrP() As polyline
      Dim P As polyline
      Dim arrM As New list(Of Mesh)
      Dim mj As New mesh
      Dim clrB,clrC,blnN() As Boolean
      Dim oc,tcc As New list(Of color)
      If (clr <> Nothing) Then clrC = True
      If ((m.VertexColors.count() > 0) Or (clr <> Nothing)) Then clrB = True
      If (m.VertexColors.count() = 0) Then  m.vertexcolors.CreateMonotoneMesh(color.LightGray)
      oc = m.VertexColors.ToArray.tolist()
      Dim mv() As point3d
      Dim mo As New list(Of mesh)
      Dim fc As New list(Of MeshFace)
      Dim np As New list(Of point3d)
      Dim ni As New list(Of Integer)
      Dim ind(3) As Integer

      mv = m.Vertices.ToPoint3dArray()
      blnN = m.GetNakedEdgePointStatus()
      arrP = m.GetNakedEdges()

      For i = 0 To ubound(blnN) Step 1
        If blnN(i) Then
          np.add(mv(i))
          ni.add(i)
        End If
      Next

      Dim cld As New pointcloud(np.toarray())
      For i = 0 To ubound(arrP) Step 1
        Dim tm As New mesh
        tm.Vertices.Clear()
        tm.Faces.Clear()

        p = arrP(i)
        If (O And (p.count() < 6)) Then
          ind(0) = ni(cld.ClosestPoint(p(0)))
          ind(1) = ni(cld.ClosestPoint(p(1)))
          ind(2) = ni(cld.ClosestPoint(p(2)))
          ind(3) = ni(cld.ClosestPoint(p(3)))
          tm.Vertices.Add(mv(ind(0)))
          tm.Vertices.Add(mv(ind(1)))
          tm.Vertices.Add(mv(ind(2)))

          tm.VertexColors.Add(oc(ind(0)))
          tm.VertexColors.Add(oc(ind(1)))
          tm.VertexColors.Add(oc(ind(2)))
          If p.count() = 5 Then
            fc.add(New meshface(ind(0), ind(1), ind(2), ind(3)))
            tm.Vertices.Add(mv(ind(3)))
            tm.VertexColors.Add(oc(ind(3)))
            tm.Faces.addface(New meshface(0, 1, 2, 3))
          ElseIf p.count() = 4 Then
            fc.add(New meshface(ind(0), ind(1), ind(2)))
            tm.Faces.addface(New meshface(0, 1, 2))
          End If
          tm.FaceNormals.ComputeFaceNormals()
          tm.Normals.ComputeNormals()
          mo.add(tm)

        Else
          Dim tx As New mesh
          Dim vec As New vector3d
          Dim tv As New list(Of point3d)
          Dim tc As New list(Of color)
          Dim tfc As New list(Of meshface)
          Dim r,g,b As Integer
          Dim tcl As color
          k = cld.ClosestPoint(p(0))
          ka = k
          tx.Vertices.AddVertices(p.ToArray())
          tx.Faces.AddFaces(p.TriangulateClosedPolyline())
          tx.Normals.ComputeNormals()

          vec = tx.Normals(0)

          tv.add(p(0))
          tc.add(oc(k))
          r = oc(ni(k)).R
          g = oc(ni(k)).G
          b = oc(ni(k)).B
          For j = 1 To p.count() - 2 Step 1
            kk = cld.ClosestPoint(p(j))
            fc.add(New meshface(m.Vertices.count(), ni(k), ni(kk)))
            vec += tx.Normals(j)
            k = kk

            tv.add(p(j))
            tc.add(oc(k))
            r += oc(ni(k)).R
            g += oc(ni(k)).G
            b += oc(ni(k)).B
            tfc.add(New meshface(p.count() - 1, j - 1, j))
          Next
          fc.add(New meshface(m.Vertices.count(), ni(k), ni(ka)))
          vec.Unitize()
          vec *= D
          m.Vertices.add(p.CenterPoint() + vec)

          r /= (p.count() - 1)
          g /= (p.count() - 1)
          b /= (p.count() - 1)
          If r > 255 Then r = 255 Else If r < 0 Then r = 0
          If g > 255 Then g = 255 Else If g < 0 Then g = 0
          If b > 255 Then b = 255 Else If b < 0 Then b = 0
          If clrC Then tcl = clr Else tcl = color.FromArgb(r, g, b)
          m.VertexColors.Add(tcl)

          tv.add(p.CenterPoint() + vec)
          tc.add(tcl)
          tfc.add(New meshface(p.count() - 1, p.count() - 2, 0))
          tm.vertices.AddVertices(tv.toarray())
          If clrB Then tm.VertexColors.AppendColors(tc.toarray())
          tm.faces.addfaces(tfc)
          tm.FaceNormals.ComputeFaceNormals()
          tm.Normals.ComputeNormals()
          mo.add(tm)
        End If
      Next

      If w Then
        m.Faces.AddFaces(fc)
        m.FaceNormals.ComputeFaceNormals()
        m.UnifyNormals()
        m.Normals.ComputeNormals()
        If Not clrB Then m.VertexColors.Clear()
        A = m
      Else
        A = mo
      End If
      E = arrP
    End If
# ---------- m_caps: VB additional code ----------
  Private Function avgC(ByVal R As Double, ByVal G As Double, ByVal B As Double, ByVal T As Integer)

    R /= t
    G /= t
    B /= t
    If R > 255 Then R = 255 Else If R < 0 Then R = 0
    If G > 255 Then G = 255 Else If G < 0 Then G = 0
    If B > 255 Then B = 255 Else If B < 0 Then B = 0

    Return color.FromArgb(CInt(R), CInt(G), CInt(B))
  End Function
# ---------- end m_caps ----------
mjoin_2 = MeshJoin(Meshes=[renumber, m_caps.A])
wbjoin = WeaverbirdsJoinMeshesAndWeld(Mesh=flatten(mjoin_2), Weld=False)
facen = FaceNormals(Mesh=wbjoin)  # -> Centers, Normals
vdis = VectorDisplay(Anchor=facen.Centers, Vector=facen.Normals)
material = CreateMaterial(
    Diffuse=ColourSwatch(SwatchColor=RGB(235, 63, 112)),
    Specular=ColourSwatch(SwatchColor=RGB(255, 255, 255)),
    Emission=ColourSwatch(SwatchColor=RGB(0, 0, 0)),
    Transparency=0,
    Shine=Slider(24, range=0..100))
section_slider = Slider(0.35, range=0..1)
pt = ConstructPoint(XCoordinate=0, YCoordinate=0, ZCoordinate=0)
launchxpwin = LaunchTransparentWindow(Show=Toggle(False), Name="TEST 1", Width=450, Height=700, ChildStatus=1)
panel_2 = Panel("""XY SECTION PLANE
XZ SECTION PLANE
YZ SECTION PLANE""")
preview = CustomPreview(Geometry=wbjoin, Shader=material)
winprops = SetWindowProperties(
    Window=launchxpwin,
    StartingLocation=pt,
    Theme=Toggle(False),
    ShowTitleBar=Toggle(False),
    BackgroundColor=ColourSwatch(SwatchColor=RGBA(255, 255, 255, 90)))
pulldown = CreatePulldownMenu(ListItems=panel_2, SelectedIndex=0)
slider = CreateSlider(Slider=section_slider, ShowBounds=False, ShowTicks=False, ShowTooltip=False, ShowValLabel=True)
bbox = BoundingBox(Content=flatten(wbjoin), Plane=PlaneXY(0, 0, 0), UnionBox=True)  # -> Box, Box_2
values = ValueListener(Elements=slider, SomeProperty=True)  # -> Values, Indices
values_2 = ValueListener(Elements=pulldown, SomeProperty=True)  # -> Values, Indices
mindex = MemberIndex(Set=panel_2, Member=values_2.Values)  # -> Index, Count
_3dview = Create3DView(MeshToDisplay=bbox.Box, MeshColors=RGB(255, 0, 0), ViewWidth=400, ViewHeight=400)
mesh_2 = Mesh(wbjoin)
panel_3 = Panel("""0
0""")
mesh_3 = Mesh(wbjoin)
set3dview = Set3DView(_3DView=_3dview, MeshToDisplay=flatten(mesh_2), MeshColors=ColourSwatch(SwatchColor=RGB(212, 212, 212)))
shift = ShiftList(List=[panel_3, values.Values], Shift=mindex.Index, Wrap=True)
bbox_2 = BoundingBox(Content=mesh_3, Plane=PlaneXY(0, 0, 0), UnionBox=True)  # -> Box, Box_2
item_5 = ListItem(List=shift, Index=0, Wrap=True)  # -> Item, Item1, Item2
box = EvaluateBox(Box=bbox_2.Box, UParameter=item_5.Item, VParameter=item_5.Item1, WParameter=item_5.Item2)  # -> Plane, Point, Include
xz = XZPlane(Origin=box.Point)
yz = YZPlane(Origin=box.Point)
checkbox = CreateCheckbox(Label="INVERT SIDE", StartingValue=False)
filter_4 = StreamFilter(Gate=mindex.Index, Stream0=box.Plane, Stream1=xz, Stream2=yz)
deplane = DeconstructPlane(Plane=filter_4)  # -> Origin, XAxis, YAxis, ZAxis
rev = Reverse(Vector=deplane.ZAxis)
padjust = AdjustPlane(Plane=filter_4, Normal=rev)
values_3 = ValueListener(Elements=checkbox, SomeProperty=True)  # -> Values, Indices
filter_5 = StreamFilter(Gate=values_3.Values, Stream0=filter_4, Stream1=padjust)
deplane_2 = DeconstructPlane(Plane=filter_5)  # -> Origin, XAxis, YAxis, ZAxis
rev_2 = Reverse(Vector=deplane_2.ZAxis)  # -> unitize(Vector)
move = Move(Geometry=filter_5, Motion=expr("x*0.01", unitize(rev_2)))  # -> Geometry, Transform
checkbox_2 = CreateCheckbox(Label="MAKE SECTION", StartingValue=False)
sec = MeshPlane(Mesh=mesh_3, Plane=move.Geometry)
merge = Merge(Data1=_3dview, Data2=checkbox_2, Data3=pulldown, Data4=checkbox, Data5=slider)
join = JoinCurves(Curves=sec, Preserve=False)
rectangle = Rectangle(Plane=filter_5, XSize=Domain(-1, 1), YSize=Domain(-2, 2), Radius=0)  # -> Rectangle, Length
boundary = BoundarySurfaces(Edges=join)
runion = RegionUnion(Curves=join, Plane=move.Geometry)
values_4 = ValueListener(Elements=checkbox_2, SomeProperty=True)  # -> Values, Indices
python = PythonScript()  # -> out, a
# ---------- python: Python ----------
import rhinoscriptsyntax as rs 


rs.c
# ---------- end python ----------
addelems = AddElements(Window=launchxpwin, Elements=flatten(merge))  # -> AddedElements, ElementNames
boundary_2 = BoundarySurfaces(Edges=rectangle.Rectangle)
layername = Panel("clippingPlane")
bool = Boolean(values_4.Values)
gate = StreamGate(Stream=boundary, Gate=values_4.Values)  # -> Target0, Target1
not = GateNot(A=bool)
cluster_19 = Cluster_6(geo=boundary_2, activate=bool, clippingplanelayer=layername)
delonlay = DeleteOnLayer(Run=not, Layer=layername, enableFullPath=False)
material_2 = CreateMaterial(
    Diffuse=ColourSwatch(SwatchColor=RGB(48, 0, 0)),
    Specular=RGB(255, 255, 255),
    Emission=RGB(0, 0, 0),
    Transparency=0,
    Shine=0)
preview_2 = CustomPreview(Geometry=gate.Target1, Shader=material_2)

mesh_4 = Mesh(<mesh referenced from the Rhino model>)
weldvertices = MeshWeldVertices(Mesh=mesh_4, Tolerance=0.01)  # -> RuntimeMessage, Mesh

unifynormals = MeshUnifyNormals(Mesh=weldvertices.Mesh)

mesh_5 = Mesh(unifynormals)
demesh = DeconstructMesh(Mesh=mesh_5)  # -> Vertices, Faces, Colours, flatten(Normals)

meshcurvature_0_31 = PythonScript(Mesh=mesh_5, Normals=demesh.Normals)  # -> out, flatten(minRad), flatten(maxRad), flatten(mean), flatten(gausian), flatten(minDir), flatten(maxDir); inputs Mesh: Mesh, Normals: list of Point3d
# ---------- meshcurvature_0_31: Python ----------
#Mesh Pseudo Curvature Analysis v0.31 - 17/12/2013
#by Mirco Becker - mirco.becker@informance-design.com

import math
import random
import rhinoscriptsyntax as rs
import Rhino
import Rhino.Geometry as rg

obj = Mesh

commonMesh = rg.Mesh()
commonMesh = obj
minRad = []
maxRad = []
mean = []
gausian = []
minDir = []
maxDir = []
geo = []


vertices = commonMesh.Vertices
normals = Normals

for i in range(vertices.Count):

    neigbours = vertices.GetConnectedVertices(i)
    conCount = neigbours.Count
    
    minC = 10000.0
    maxC = -10000.0
    
    for j in range(neigbours.Count):
        
        vVec3d = rg.Vector3d(rg.Point3f.Subtract(vertices[i],vertices[neigbours[j]]))
        edgeLength = vVec3d.Length
        vVec3d.Unitize
        vNor3d = rg.Vector3d(normals[i])
        vAngle = rg.Vector3d.VectorAngle(vVec3d,vNor3d)
        vAngle = vAngle - math.pi * 0.5
        
        if edgeLength > 0.0:

            if not Rhino.RhinoMath.IsValidDouble(vAngle):       
                vAngle  = 0.0
                curvature = 0.0
                
            if vAngle < x and vAngle > (-1.0) * x:
                curvature = 0.0
            else:      
                curveRad = edgeLength / math.sin(vAngle)
                curvInv = 1/curveRad
                
            if curvInv< -1.0:
                curvInv = -1.0
                
            if curvInv < minC:
                minC = curvInv
                minD = vVec3d
            if curvInv > maxC:
                maxC = curvInv
                maxD = vVec3d
                
    minRad.append(maxC)
    maxRad.append(minC)
    mean.append((minC+maxC)*0.5)
    gausian.append(minC*maxC)
    minDir.append(minD)
    maxDir.append(maxD)
# ---------- end meshcurvature_0_31 ----------
num = Number(meshcurvature_0_31.mean)

list_minmax = List_MinMax(K=num)  # -> i, i_2
list_min = Panel(list_minmax.i)
list_max = Panel(list_minmax.i_2)

# ----
# Adjust Limits
# Toggle Preview for Wireframe
wireframe = FaceBoundaries(Mesh=weldvertices.Mesh)
min_adjusted = Slider(0.69, range=0..1)
max_adjusted = Slider(0.24, range=0..1)
multiplication = Multiplication(A=list_max, B=max_adjusted)
multiplication_2 = Multiplication(A=list_min, B=min_adjusted)

mygradient = Gradient(
    LowerLimit=multiplication_2,
    UpperLimit=multiplication,
    Parameter=num,
    stops=[0: RGB(0, 0, 255), 0.265: RGB(86, 191, 249), 0.497: RGB(0, 192, 0), 0.758: RGB(255, 255, 0), 1: RGB(255, 0, 0)])
mcol = MeshColours(Mesh=mesh_5, Colours=mygradient)
mblur = BlurMesh(Mesh=mcol, Iterations=3)

# ==== cluster Cluster
type_of_curve = ClusterInput()  # 0 for line, 1 for curve
branch_count = ClusterInput()
branch_lenght = ClusterInput()  # Linear lenght
branch_rotation = ClusterInput()  # plane rotation for branches
z_axis_rotation = ClusterInput()  # Branch inclination
base_plane = ClusterInput()  # Insert plane to branch off

# ---- group: Branch Curves
num = Number(branch_rotation)
G = Gate(type_of_curve)
pln = Plane(base_plane)
num_2 = Number(z_axis_rotation)
num_3 = Number(branch_lenght)
num_4 = Number(branch_count)
pi = Pi(Factor="2")
range = Range(Domain=pi, Steps=num_4)
pi_2 = Pi(Factor=num)
item = ListItem(List=pln, Index=0, Wrap=True)
shift = ShiftList(List=range, Shift="-1", Wrap=invert(True))
prot = RotatePlane(Plane=item, Angle=pi_2)
pi_3 = Pi(Factor=num_2)
pt = PointPolar(BasePlane=prot, XYAngle=shift, ZAngle=pi_3, Offset=num_3)
vec2pt = Vector2Pt(PointA=prot, PointB=pt, Unitize=False)  # -> Vector, Length
line = LineSDL(Start=prot, Direction=vec2pt.Vector, Length=vec2pt.Length)
end = EndPoints(Curve=line)  # -> Start, End
arc = ArcSED(Start=end.Start, End=end.End, Direction=prot)  # -> Arc, Plane, Radius
filter = StreamFilter(Gate=G, Stream0=line, Stream1=arc.Arc)
pln_2 = Plane(prot)
vec = Vector(vec2pt.Vector)

# ----
base_plane_2 = ClusterOutput(pln_2)  # Branch base plane
guide_vectors = ClusterOutput(vec)  # branch curve direction
branch_curves_crv = ClusterOutput(filter)  # branched curves

# ==== cluster Cluster_2
type_of_plane = ClusterInput()  # 0 for perdendicular frames, 1 for horizontal frames
branch_curves = ClusterInput()  # Insert cuves for section planes
guide_vector_s = ClusterInput()  # Curve guide Vectors
plane_section_count = ClusterInput()  # Curve plane section count
branch_base_plane_pl = ClusterInput()  # Branch base plane
rotation_transition_0_to_1 = ClusterInput()  # First rotation transition. From 0 to 1
rotation_transition_0_to_1_2 = ClusterInput()  # Second rotation transition. From 0 to 1

# ---- group: Branch Frames
G = Gate(type_of_plane)
crv = Curve(branch_curves)
pln = Plane(branch_base_plane_pl)
num = Number(rotation_transition_0_to_1)
num_2 = Number(rotation_transition_0_to_1_2)
num_3 = Number(plane_section_count)
vec = Vector(guide_vector_s)
expression = Expression(x=num_3, Expression="x-1")
project = Project(Geometry=vec, Plane=pln)  # -> Geometry, Transform
cp = ControlPoints(Curve=crv)  # -> Points, Weights, Knots
pframes = PerpFrames(Curve=crv, Count=expression, Align=True)  # -> simplify(Frames), Parameters
lng = ListLength(List=cp.Points)
hframes = HorizontalFrames(Curve=crv, Count=expression)  # -> Frames, Parameters
lng_2 = ListLength(List=crv)
expression_2 = Expression(x=lng, Expression="if(x=2,0,1)")
dup = DuplicateData(Data=pln, Number=lng_2, Order=True)
align = AlignPlane(Plane=pframes.Frames, Direction=graft(project.Geometry))  # -> simplify(Plane), Angle
align_2 = AlignPlane(Plane=hframes.Frames, Direction=vec)  # -> simplify(Plane), Angle
graft = GraftTree(Tree=dup, IncludeEmptyLists=True, IncludeNullItems=True)
lng_3 = ListLength(List=align.Plane)
dup_2 = DuplicateData(Data=expression_2, Number=lng_3, Order=True)
p_n_c = PickNChoose(Pattern=dup_2, Stream0=align_2.Plane, Stream1=hframes.Frames)
p_n_c_2 = PickNChoose(Pattern=dup_2, Stream0=align.Plane, Stream1=pframes.Frames)
filter = StreamFilter(Gate=G, Stream0=p_n_c_2, Stream1=p_n_c)
dom = ConstructDomain(DomainStart=num, DomainEnd=num_2)
range = Range(Domain=dom, Steps=expression)
deplane = DeconstructPlane(Plane=filter)  # -> Origin, XAxis, YAxis, ZAxis
angle = Angle(VectorA=filter, VectorB=graft)  # -> Angle, Reflex
line = LineSDL(Start=deplane.Origin, Direction=deplane.YAxis, Length=1000)
multiplication = Multiplication(A=angle.Angle, B=range)
neg = Negative(Value=multiplication)
rotax = RotateAxis(Geometry=filter, Angle=neg, Axis=line)  # -> simplify(Geometry), Transform

# ----
branch_frames_pl = ClusterOutput(rotax.Geometry)  # Branch Frames from Curves

# ==== cluster Cluster_3
branch_count = ClusterInput()  # Branch Count
branch_profile_curve_to_match_crv = ClusterInput()  # Profile Curve to Match
frames_from_profile_curves_to_match_pl = ClusterInput()  # Frames from Profile Curves to Match
planes_to_match_profile_with = ClusterInput()  # Planes to match Profile with
total_rotation_radians = ClusterInput()
data_to_match = Data(branch_profile_curve_to_match_crv)
planes_to_match_with = Tree(planes_to_match_profile_with)
branch_count_2 = Number(branch_count)

# ---- group: Curve Profile DM
data_to_match_2 = Data(data_to_match)
branch_count_3 = Number(branch_count_2)
planes_to_match_with_2 = Tree(planes_to_match_with)
group = Group(Objects=data_to_match_2)
dup = DuplicateData(Data=simplify(group), Number=branch_count_3, Order=True)
tstat = TreeStatistics(Tree=planes_to_match_with_2)  # -> Paths, Length, Count
graft = GraftTree(Tree=dup, IncludeEmptyLists=True, IncludeNullItems=True)
graft_2 = GraftTree(Tree=tstat.Length, IncludeEmptyLists=True, IncludeNullItems=True)
dup_2 = DuplicateData(Data=graft, Number=graft_2, Order=True)
graft_3 = GraftTree(Tree=dup_2, IncludeEmptyLists=True, IncludeNullItems=True)
ungroup = Ungroup(Group=graft_3)  # -> simplify(Objects)

# ---- group: Frames DM
data_to_match_3 = Data(frames_from_profile_curves_to_match_pl)
planes_to_match_with_3 = Tree(planes_to_match_with)
branch_count_4 = Number(branch_count_2)
group_2 = Group(Objects=data_to_match_3)
dup_3 = DuplicateData(Data=simplify(group_2), Number=branch_count_4, Order=True)
tstat_2 = TreeStatistics(Tree=planes_to_match_with_3)  # -> Paths, Length, Count
graft_4 = GraftTree(Tree=dup_3, IncludeEmptyLists=True, IncludeNullItems=True)
graft_5 = GraftTree(Tree=tstat_2.Length, IncludeEmptyLists=True, IncludeNullItems=True)
dup_4 = DuplicateData(Data=graft_4, Number=graft_5, Order=True)
graft_6 = GraftTree(Tree=dup_4, IncludeEmptyLists=True, IncludeNullItems=True)
ungroup_2 = Ungroup(Group=graft_6)  # -> simplify(Objects)

# ---- group: Rotation Values DM
profile_curves_to_match_with = Data(data_to_match)
plane_to_match_with = Tree(planes_to_match_with)
rotation_value = Number(total_rotation_radians)
tstat_3 = TreeStatistics(Tree=plane_to_match_with)  # -> Paths, Length, Count
tstat_4 = TreeStatistics(Tree=profile_curves_to_match_with)  # -> Paths, Length, Count
item = ListItem(List=tstat_4.Length, Index=0, Wrap=True)

# ----
expression = Expression(x=tstat_3.Length, Expression="x-1")
range = Range(Domain=rotation_value, Steps=expression)
graft_7 = GraftTree(Tree=range, IncludeEmptyLists=True, IncludeNullItems=True)

# ---- group: Rotation Values DM (continued)
dup_5 = DuplicateData(Data=graft_7, Number=item, Order=True)
neg = Negative(Value=dup_5)
weave = Weave(Pattern=[0, 1], Stream0=dup_5, Stream1=neg, NullGaps=False)  # -> simplify(Weave)

# ---- group: Profile Curve Placement
frames_from_profile_curves = Plane(ungroup_2)
profile_curves = Curve(ungroup)
rotation_values = Number(weave)
branch_frames = Plane(planes_to_match_with)
graft_8 = GraftTree(Tree=branch_frames, IncludeEmptyLists=True, IncludeNullItems=True)
pl_origin = PlaneOrigin(Base=frames_from_profile_curves, Origin=graft_8)

# ----
graft_9 = GraftTree(Tree=pl_origin, IncludeEmptyLists=True, IncludeNullItems=True)
partition = PartitionList(List=rotation_values, Size=2)

# ---- group: Profile Curve Placement (continued)
prot = RotatePlane(Plane=graft_9, Angle=partition)

# ----
shift = ShiftPaths(Data=prot, Offset=-1)

# ---- group: Profile Curve Placement (continued)
padjust = AdjustPlane(Plane=shift, Normal=graft_8)
orient = Orient(Geometry=profile_curves, Source=frames_from_profile_curves, Target=padjust)  # -> Geometry, Transform

# ----
profile_curves_crv = ClusterOutput(orient.Geometry)
frames_from_profile_curves_pl = ClusterOutput(padjust)  # Frames from Profile Curves

# ==== cluster Cluster_4
profile_curves_from_branch_crv = ClusterInput()  # Profile curves section to choose from
branch_path_int = ClusterInput()  # Connect integers numbers to create branch path
branch_item_selection_0_1 = ClusterInput()  # 0 to use last branch item, 1 to select branch item
profile_curve_frames_from_branch_pl = ClusterInput()  # Profile Curve Frames from Branch to choose from

# ---- group: branch sorting
int = Integer(branch_item_selection_0_1)
crv = Curve(simplify(profile_curves_from_branch_crv))
pln = Plane(simplify(profile_curve_frames_from_branch_pl))
int_2 = Integer(branch_path_int)
tstat = TreeStatistics(Tree=crv)  # -> Paths, Length, Count
item = ListItem(List=reverse(tstat.Paths), Index=0, Wrap=True)
dpath = DeconstructPath(Branch=item)
sort = SortList(Keys=dpath)  # -> reverse(Keys), ValuesA
item_2 = ListItem(List=sort.Keys, Index=0, Wrap=True)
path_mask = Panel("{*;x;*}")
to_replace = Panel("x")
int_3 = Integer(item_2)
rep = ReplaceText(Text=path_mask, Find=to_replace, Replace=int_3, RecursiveReplace=False)
path = ConstructPath(Indices=int_2)

# ----
filter = StreamFilter(Gate=int, Stream0=rep, Stream1=path)

# ---- group: branch sorting (continued)
split = SplitTree(Data=crv, Masks=flatten(filter))  # -> Positive, Negative
split_2 = SplitTree(Data=pln, Masks=flatten(filter))  # -> Positive, Negative

# ----
selected_profile_curves = ClusterOutput(split.Positive)  # Selected Profile Curves
selected_profile_curve_frames = ClusterOutput(split_2.Positive)  # Selected Profile Curve Frames
selected_path_tree_index = ClusterOutput(filter)  # Selected Path (Tree Index)

# ==== cluster Cluster_5
profile_curves_from_branch_crv = ClusterInput()  # Profile curves section to choose from

# ---- group: Curve intersection recurtion
crv = Curve(profile_curves_from_branch_crv)
lng = ListLength(List=crv)
logn = LogN(Number=lng, Base=2)  # -> expr("x-1", Result)
item = ListItem(List=flatten(logn), Index=0, Wrap=True)
fastloopstart = FastLoopStart(Iterations=item, Data=crv)  # -> port, Counter, Data
partition = PartitionList(List=fastloopstart.Data, Size="2")
item_2 = ListItem(List=partition, Index=0, Wrap=True)  # -> Item, Item1
rint = RegionIntersection(CurvesA=item_2.Item, CurvesB=item_2.Item1)  # -> simplify(Result)
shift = ShiftPaths(Data=rint, Offset=-1)
fastloopend = FastLoopEnd(port=fastloopstart.port, Exit=False, Data=shift, RecordData=False, TimeOutVal=0)  # -> graft(Data)

# ----
intersected_curves_crv = ClusterOutput(fastloopend)

# ==== cluster Visualization
intersected_curves_crv = ClusterInput()  # Intersected Profile Cruves to create Geometry
branch_frames_pl = ClusterInput()  # Branch frames from curves
refinement = ClusterInput()  # Number of subidivisions to create sweep surface

# ---- group: Sweep Column
branch_frames = Plane(branch_frames_pl)
intersected_curves = Curve(intersected_curves_crv)
graft = GraftTree(Tree=branch_frames, IncludeEmptyLists=True, IncludeNullItems=True)
deplane = DeconstructPlane(Plane=graft)  # -> Origin, XAxis, YAxis, ZAxis
line = LineSDL(Start=deplane.Origin, Direction=deplane.XAxis, Length="1000")
ccx = CurveCurve(CurveA=intersected_curves, CurveB=line)  # -> Points, ParamsA, ParamsB
range = Range(Domain=Domain(0, 1), Steps=refinement)
seam = Seam(Curve=intersected_curves, Seam=ccx.ParamsA)  # -> simplify(Curve)
shift = ShiftList(List=range, Shift=-1, Wrap=invert(True))
shatter = Shatter(Curve=reparameterize(seam), Parameters=shift)  # -> simplify(Segments)
tstat = TreeStatistics(Tree=shatter)  # -> Paths, Length, Count
item = ListItem(List=tstat.Paths, Index=0, Wrap=True)
dpath = DeconstructPath(Branch=item)
shift_2 = ShiftList(List=dpath, Shift=-1, Wrap=invert(True))
join = TextJoin(Text=shift_2, Join=";")
concat = Concatenate(FragmentA="{", FragmentB=join, FragmentC=";+1", FragmentD="}")
relitem = RelativeItem(Tree=simplify(shatter), Offset=concat, WrapPaths=False, WrapItems=False)  # -> ItemA, ItemB
end = EndPoints(Curve=relitem.ItemA)  # -> Start, End
end_2 = EndPoints(Curve=relitem.ItemB)  # -> Start, End
ln = Line(StartPoint=end.Start, EndPoint=end_2.Start)
swp2 = Sweep2(
    Rail1=reparameterize(graft(relitem.ItemA)),
    Rail2=reparameterize(graft(relitem.ItemB)),
    Sections=reparameterize(graft(ln)),
    SameHeight=False)  # -> simplify(Brep)
shift_3 = ShiftPaths(Data=swp2, Offset=-2)

# ---- group: Mesh loft visualization
crv = Curve(seam)
shift_4 = ShiftPaths(Data=crv, Offset=-1)
mloft = MeshLoft(Curves=shift_4, Segments=200)
wbjoin = WeaverbirdsJoinMeshesAndWeld(Mesh=mloft, Weld=invert(False))

# ---- group: Mesh from sweep srf
mesh_uv = MeshSurface(UCount=100, VCount=5, Overhang=invert(True), Equalize=False)
wbjoin_2 = WeaverbirdsJoinMeshesAndWeld(Mesh=mesh_uv, Weld=invert(False))

# ----
join_2 = BrepJoin(Breps=shift_3)  # -> Breps, Closed
mesh = MeshBrep(
    Brep=shift_3,
    Settings={GridMaxCount=0, GridMinCount=16, JaggedSeams=False, MaxEdgeLength=0, MinEdgeLength=0.0001, MinTolerance=0, Refine=True, RefineAngle=0, RelativeTolerance=0.65, SimplePlanes=True, Tolerance=0})  # disabled
mjoin = MeshJoin(Meshes=mesh)  # disabled
mesh_from_loft_m = ClusterOutput(wbjoin)  # Mesh loft from intersected curves
sweep_surface = ClusterOutput(join_2.Breps)  # Sweep surface from Instersected Curves
mesh_from_sweep_curface_m = ClusterOutput(mjoin)  # Mesh from intersected curves

# ==== cluster Cluster_6
geo = ClusterInput()
geo_2 = Geometry(geo)
explode = BrepComponents(Brep=geo_2)  # -> Faces, Edges, Vertices
flip = Flip(Surface=explode.Faces)  # -> Surface, Result
explode_2 = BrepComponents(Brep=flip.Surface)  # -> Faces, Edges, simplify(Vertices)
join = JoinCurves(Curves=explode_2.Edges, Preserve=False)
planar = PlanarSrf(Edges=join)
explode_3 = BrepComponents(Brep=planar)  # -> Faces, Edges, reverse(simplify(Vertices))
item = ListItem(List=explode_3.Vertices, Index=1, Wrap=False)
item_2 = ListItem(List=explode_3.Vertices, Index=0, Wrap=False)
item_3 = ListItem(List=explode_3.Vertices, Index=2, Wrap=False)
pt = Point(flatten(item))
pt_2 = Point(flatten(item_2))
pt_3 = Point(flatten(item_3))
activate = ClusterInput()
clippingplanelayer = ClusterInput()
python_sectionboxer = PythonScript(p1=pt_2, p2=pt, p3=pt_3, activate=activate, clippingPlaneLayer=clippingplanelayer)  # -> out, a; inputs p1: list of Point3d, p2: list of Point3d, p3: list of Point3d
# ---------- python_sectionboxer: Python ----------
import math
import rhinoscriptsyntax as rs
import scriptcontext as sc
import Rhino
sc.doc = Rhino.RhinoDoc.ActiveDoc

layerName=clippingPlaneLayer
if activate:
    lay=rs.CurrentLayer()
    rs.AddLayer(layerName)
    rs.CurrentLayer(layerName)
    rs.LayerVisible(layerName,True,True)
    objectlist= rs.ObjectsByLayer(layerName)
    for j in range (0,len(objectlist)):
        if rs.ObjectType(objectlist[j])==536870912:
            rs.DeleteObject(objectlist[j])
    for i in range(0, len(p1)):
        rs.Command("-_ClippingPlane P " +str(p1[i])+" "+str(p2[i])+" "+str(p3[i])+" "+"_Enter")
    if rs.CurrentLayer(lay)==rs.CurrentLayer():
        rs.CurrentLayer("Default")
    else:
        rs.CurrentLayer(lay)
    rs.LayerVisible(layerName,False,False)
# ---------- end python_sectionboxer ----------

# ==== cluster List_MinMax
K = ClusterInput()
sort = SortList(Keys=K)  # -> Keys, ValuesA
item = ListItem(List=reverse(sort.Keys), Index=0, Wrap=True)
item_2 = ListItem(List=sort.Keys, Index=0, Wrap=True)
i = ClusterOutput(item_2)
i_2 = ClusterOutput(item)
