# Grasshopper definition Digital Column Gaudi.gh (Grasshopper 0.9.76)
# plug-ins: treesloth01, Anemone

# ---- group: Gaudi profile curve
resolution = Slider(8, range=0..10)
oscilations = Slider(10, range=0..20)
pi = Pi(Factor=2)
multiplication = Multiplication(A=resolution, B=oscilations)
range = Range(Domain=oscilations, Steps=multiplication)
range_2 = Range(Domain=pi, Steps=multiplication)
pi_2 = Pi(Factor=range)
sin = Sine(Value=pi_2)
bnd = Bounds(Numbers=sin)
dom = ConstructDomain(DomainStart=Slider(319, range=200..500), DomainEnd=Slider(500, range=200..500))
remap = RemapNumbers(Value=sin, Source=bnd, Target=dom)  # -> Mapped, Clipped
pt = PointCylindrical(BasePlane=PlaneXY(0, 0, 0), Angle=range_2, Radius=remap.Mapped, Elevation=0)
intcrv = Interpolate(Vertices=pt, Degree=3, Periodic=False, KnotStyle=1)  # -> Curve, Length, Domain

# ---- group: ROTATION BY LEVELS / levels
series = Series(Start="2", Step=1, Count=Slider(4, range=1..5))

# ---- group: ROTATION BY LEVELS / gaudi column sides
division = Division(A=oscilations, B="2")

# ---- group: ROTATION BY LEVELS / circumference
pi_3 = Pi(Factor=2)

# ---- group: ROTATION BY LEVELS
expression = Expression(x=pi_3, y=division, z=series, Expression="(x/y)/(2^z)")
panel = Panel(expression)
item = ListItem(List=expression, Index=0, Wrap=True)  # -> Item, Item1, Item2, Item3

# ----
xy = XYPlane(Origin=Point(0, 0, 0))

# ---- group: Single Branch Curve translation
crv = Curve(intcrv.Curve)
number_slider = Slider(10, range=0..10)
pln = Plane(xy)
expression_2 = Expression(x=number_slider, Expression="x-1")
line = LineSDL(Start=pln, Direction=Vector(0, 0, 1), Length=Slider(3000, range=0..5000))
pframes = PerpFrames(Curve=line, Count=expression_2, Align=True)  # -> graft(Frames), Parameters
pln_2 = Plane(pframes.Frames)

# ---- group: Single Branch Curve translation / rotation values +/-
num = Number(item.Item)
expression_3 = Expression(x=number_slider, Expression="x-1")
range_3 = Range(Domain=num, Steps=expression_3)  # -> graft(Range)
neg = Negative(Value=range_3)
num_2 = Number([range_3, neg])

# ---- group: Single Branch Curve translation (continued)
prot = RotatePlane(Plane=pframes.Frames, Angle=num_2)
orient = Orient(Geometry=crv, Source=PlaneXY(0, 0, 0), Target=prot)  # -> Geometry, Transform
pln_3 = Plane(prot)
crv_2 = Curve(orient.Geometry)

# ---- group: branch sorting
crv_3 = Curve(crv_2)
pln_4 = Plane(pln_3)
tstat = TreeStatistics(Tree=crv_3)  # -> Paths, Length, Count
item_2 = ListItem(List=reverse(tstat.Paths), Index=0, Wrap=True)
dpath = DeconstructPath(Branch=item_2)
sort = SortList(Keys=dpath)  # -> reverse(Keys), ValuesA
item_3 = ListItem(List=sort.Keys, Index=0, Wrap=True)
path_mask = Panel("{*;x;*}")
to_replace = Panel("x")
int = Integer(item_3)
rep = ReplaceText(Text=path_mask, Find=to_replace, Replace=int, RecursiveReplace=False)
split = SplitTree(Data=crv_3, Masks=flatten(rep))  # -> Positive, Negative
split_2 = SplitTree(Data=pln_4, Masks=flatten(rep))  # -> Positive, Negative

# ---- group: Curve intersection recurtion
crv_4 = Curve(crv_2)
fastloopstart = FastLoopStart(Iterations=Slider(0, range=0..3), Data=crv_4)  # -> port, Counter, Data
partition = PartitionList(List=fastloopstart.Data, Size="2")
item_4 = ListItem(List=partition, Index=0, Wrap=True)  # -> Item, Item1
rint = RegionIntersection(CurvesA=item_4.Item, CurvesB=item_4.Item1)  # -> simplify(Result)
shift = ShiftPaths(Data=rint, Offset=-1)
fastloopend = FastLoopEnd(port=fastloopstart.port, Exit=False, Data=shift, RecordData=False, TimeOutVal=0)  # -> graft(Data)

# ---- group: Sweep Column
pln_5 = Plane(pln_2)
crv_5 = Curve(fastloopend)
deplane = DeconstructPlane(Plane=pln_5)  # -> Origin, XAxis, YAxis, ZAxis
line_2 = LineSDL(Start=deplane.Origin, Direction=deplane.XAxis, Length="1000")
ccx = CurveCurve(CurveA=crv_5, CurveB=line_2)  # -> Points, ParamsA, ParamsB
seam = Seam(Curve=crv_5, Seam=ccx.ParamsA)  # -> simplify(Curve)
shift_2 = ShiftPaths(Data=seam, Offset=-1)
relitem = RelativeItem(Tree=simplify(shift_2), Offset="{0}(+1)", WrapPaths=False, WrapItems=False)  # -> ItemA, ItemB
end = EndPoints(Curve=relitem.ItemA)  # -> Start, End
end_2 = EndPoints(Curve=relitem.ItemB)  # -> Start, End
ln = Line(StartPoint=end.Start, EndPoint=end_2.Start)
swp2 = Sweep2(
    Rail1=reparameterize(graft(relitem.ItemA)),
    Rail2=reparameterize(graft(relitem.ItemB)),
    Sections=reparameterize(graft(ln)),
    SameHeight=False)

# ---- group: column visualization
brep = Brep(swp2)
mesh = MeshBrep(
    Brep=brep,
    Settings={GridMaxCount=0, GridMinCount=16, JaggedSeams=False, MaxEdgeLength=0, MinEdgeLength=0.0001, MinTolerance=0, Refine=True, RefineAngle=0, RelativeTolerance=0.65, SimplePlanes=True, Tolerance=0})
mjoin = MeshJoin(Meshes=flatten(mesh))
material = CreateMaterial(
    Diffuse=ColourSwatch(SwatchColor=RGB(255, 255, 255)),
    Specular=RGB(255, 255, 255),
    Emission=RGB(0, 0, 0),
    Transparency=0,
    Shine=Slider(24, range=0..100))
preview = CustomPreview(Geometry=mjoin, Shader=material)
